# Grasshopper definition Assignment 2 hatch.gh (Grasshopper 1.0.8)
# plug-ins: Pufferfish, LunchBox, MetaHopper

brep = Brep([<brep referenced from the Rhino model> x3])
brep_2 = Brep([<brep referenced from the Rhino model> x2])
value_list = ValueList({"Normal": 0, "Faint": 1, "Hidden": 2}, selected="Faint")
control_wire_display = ControlWireDisplay(WireDisplay=value_list)

xy_plane = XYPlane(Origin=[<geometry referenced from the Rhino model> x3])
unroll_polysurface = UnrollPolysurface(Polysurface=brep, Plane=xy_plane)  # -> flatten(Unrolled), UnrolledPoints, UnrolledCurves
brep_join = BrepJoin(Breps=unroll_polysurface.Unrolled)  # -> Breps, Closed
brep_edges = BrepEdges(Brep=brep_join.Breps)  # -> Naked, Interior, NonManifold

brep_edges_2 = BrepEdges(Brep=brep_join.Breps)  # -> flatten(Naked), Interior, NonManifold
panel = Panel(brep_edges_2.Naked)
curve = Curve(brep_edges.Interior)
list_item = ListItem(List=brep_edges_2.Naked, Index=Slider(5, range=0..100), Wrap=True)

join_curves = JoinCurves(Curves=[brep_edges.Naked, curve], Preserve=False)  # -> flatten(Curves)
list_item_2 = ListItem(List=join_curves, Index=Slider(3, range=0..10), Wrap=True)
panel_2 = Panel(join_curves)
boundary_surfaces = BoundarySurfaces(Edges=join_curves)
surface = Surface(boundary_surfaces)

cull_pattern = CullPattern(List=brep_edges_2.Naked, CullPattern=[False, False, True, True])

bounding_box = BoundingBox(Content=surface, Plane=PlaneXY(0, 0, 0))  # -> Box, Box_2
brep_edges_3 = BrepEdges(Brep=bounding_box.Box)  # -> Naked, Interior, NonManifold
panel_3 = Panel(brep_edges_3.Naked)
join_curves_2 = JoinCurves(Curves=flatten(brep_edges_3.Naked), Preserve=False)
offset_curve = OffsetCurve(Curve=join_curves_2, Distance=Slider(4.32, range=0..10), Plane=xy_plane, Corners=1)

# ---- group: Hatch 1
number_slider = Slider(0, range=0..13)
brep_edges_4 = BrepEdges(Brep=offset_curve)  # -> flatten(Naked), Interior, NonManifold
addition = Addition(A=number_slider, B=1)
list_item_3 = ListItem(List=brep_edges_4.Naked, Index=number_slider, Wrap=True)
panel_4 = Panel(brep_edges_4.Naked)
list_item_4 = ListItem(List=brep_edges_4.Naked, Index=addition, Wrap=True)
length = Length(Curve=list_item_4)
unit_vector = UnitVector(Vector=list_item_4)
divide_length = DivideLength(Curve=list_item_3, Length=Slider(0.3, range=0..10))  # -> Points, Tangents, Parameters
line_sdl = LineSDL(Start=divide_length.Points, Direction=unit_vector, Length=length)
hatch_angle = Slider(45, range=0..100)
point_on_curve = PointOnCurve(line_sdl, parameter=0.5)
deconstruct_brep = DeconstructBrep(Brep=brep_join.Breps)  # -> simplify(graft(Faces)), Edges, Vertices
rotate = Rotate(Geometry=line_sdl, Angle=degrees(hatch_angle), Plane=point_on_curve)  # -> Geometry, Transform
explode_tree = ExplodeTree(Data=deconstruct_brep.Faces)  # -> Branch0, Branch1, Branch2, Branch3
panel_5 = Panel(deconstruct_brep.Faces)
project_curve = ProjectCurve(Curve=rotate.Geometry, Brep=explode_tree.Branch0, Direction=Vector(0, 0, 1))

number_slider_2 = Slider(4, range=0..13)
addition_2 = Addition(A=number_slider_2, B=1)
list_item_5 = ListItem(List=brep_edges_4.Naked, Index=number_slider_2, Wrap=True)
list_item_6 = ListItem(List=brep_edges_4.Naked, Index=addition_2, Wrap=True)
number_slider_3 = Slider(0.3, range=0..10)
length_2 = Length(Curve=list_item_6)
unit_vector_2 = UnitVector(Vector=list_item_6)
divide_length_2 = DivideLength(Curve=list_item_5, Length=number_slider_3)  # -> Points, Tangents, Parameters
line_sdl_2 = LineSDL(Start=divide_length_2.Points, Direction=unit_vector_2, Length=length_2)
hatch_angle_2 = Slider(45, range=0..100)
point_on_curve_2 = PointOnCurve(line_sdl_2, parameter=0.5)
rotate_2 = Rotate(Geometry=line_sdl_2, Angle=degrees(hatch_angle_2), Plane=point_on_curve_2)  # -> Geometry, Transform
deconstruct_brep_2 = DeconstructBrep(Brep=brep_join.Breps)  # -> simplify(graft(Faces)), Edges, Vertices
explode_tree_2 = ExplodeTree(Data=deconstruct_brep_2.Faces)  # -> Branch0, Branch1, Branch2, Branch3
project_curve_2 = ProjectCurve(Curve=rotate_2.Geometry, Brep=explode_tree_2.Branch1, Direction=Vector(0, 0, 1))

number_slider_4 = Slider(8, range=0..13)
addition_3 = Addition(A=number_slider_4, B=1)
list_item_7 = ListItem(List=brep_edges_4.Naked, Index=number_slider_4, Wrap=True)
list_item_8 = ListItem(List=brep_edges_4.Naked, Index=addition_3, Wrap=True)
length_3 = Length(Curve=list_item_8)
unit_vector_3 = UnitVector(Vector=list_item_8)
divide_length_3 = DivideLength(Curve=list_item_7, Length=Slider(0.3, range=0..10))  # -> Points, Tangents, Parameters
line_sdl_3 = LineSDL(Start=divide_length_3.Points, Direction=unit_vector_3, Length=length_3)
hatch_angle_3 = Slider(45, range=0..100)
point_on_curve_3 = PointOnCurve(line_sdl_3, parameter=0.5)
rotate_3 = Rotate(Geometry=line_sdl_3, Angle=degrees(hatch_angle_3), Plane=point_on_curve_3)  # -> Geometry, Transform
deconstruct_brep_3 = DeconstructBrep(Brep=brep_join.Breps)  # -> simplify(graft(Faces)), Edges, Vertices
explode_tree_3 = ExplodeTree(Data=deconstruct_brep_3.Faces)  # -> Branch0, Branch1, Branch2, Branch3
project_curve_3 = ProjectCurve(Curve=rotate_3.Geometry, Brep=explode_tree_3.Branch3, Direction=Vector(0, 0, 1))
project_curve_4 = ProjectCurve(Curve=rotate_3.Geometry, Brep=explode_tree_3.Branch2, Direction=Vector(0, 0, 1))

# ---- group: Projective Hatch on Srf
surface_1_1 = Surface(explode_tree.Branch0)
surface_1_2 = Surface(explode_tree_2.Branch1)
surface_2 = Surface(explode_tree_3.Branch2)
deconstruct_brep_4 = DeconstructBrep(Brep=brep)  # -> flatten(Faces), Edges, Vertices
surface_3 = Surface(explode_tree_3.Branch3)
panel_6 = Panel(deconstruct_brep_4.Faces)
reverse_surface_direction = ReverseSurfaceDirection(Surface=surface_1_2, ReverseOption=Slider(2, range=0..10))
reverse_surface_direction_2 = ReverseSurfaceDirection(Surface=surface_1_1, ReverseOption=Slider(2, range=0..10))
list_item_9 = ListItem(List=deconstruct_brep_4.Faces, Index=Slider(5, range=0..10), Wrap=True)
explode_tree_4 = ExplodeTree(Data=graft(deconstruct_brep_4.Faces))  # -> Branch0, Branch1, Branch2, Branch3
number_slider_5 = Slider(0.45, range=0..1)
map_to_surface = MapToSurface(Curve=project_curve, Source=reverse_surface_direction_2, Target=explode_tree_4.Branch0)
map_to_surface_2 = MapToSurface(Curve=project_curve_4, Source=surface_2, Target=explode_tree_4.Branch2)
map_to_surface_3 = MapToSurface(Curve=project_curve_3, Source=surface_3, Target=explode_tree_4.Branch3)
map_to_surface_4 = MapToSurface(Curve=project_curve_2, Source=reverse_surface_direction, Target=explode_tree_4.Branch1)
extend_curve = ExtendCurve(Curve=map_to_surface, Type=0, Start=number_slider_5, End=number_slider_5)
extend_curve_2 = ExtendCurve(Curve=map_to_surface_3, Type=0, Start=number_slider_5, End=number_slider_5)
extend_curve_3 = ExtendCurve(Curve=map_to_surface_2, Type=0, Start=number_slider_5, End=number_slider_5)
extend_curve_4 = ExtendCurve(Curve=map_to_surface_4, Type=0, Start=number_slider_5, End=number_slider_5)
rebuild_curve = RebuildCurve(Curve=extend_curve, Degree=1, Count=2, Tangents=False)
rebuild_curve_2 = RebuildCurve(Curve=extend_curve_4, Degree=1, Count=2, Tangents=False)
rebuild_curve_3 = RebuildCurve(Curve=extend_curve_3, Degree=1, Count=2, Tangents=False)
rebuild_curve_4 = RebuildCurve(Curve=extend_curve_2, Degree=1, Count=2, Tangents=False)

# ----
number = Number(number_slider_3)
number_2 = Number(number_slider_3)
number_3 = Number(number_slider_3)
number_4 = Number(number_slider_3)
division = Division(A=number, B=Slider(6, range=2..6))
division_2 = Division(A=number_2, B=Slider(6, range=2..6))
division_3 = Division(A=number_3, B=Slider(6, range=2..6))
division_4 = Division(A=number_4, B=Slider(6, range=2..6))
pipe = Pipe(Curve=rebuild_curve_3, Radius=division, Caps=1)
pipe_2 = Pipe(Curve=rebuild_curve_2, Radius=division_3, Caps=1)
pipe_3 = Pipe(Curve=rebuild_curve_4, Radius=division_2, Caps=1)
pipe_4 = Pipe(Curve=rebuild_curve, Radius=division_4, Caps=1)
cap_holes = CapHoles(Brep=pipe_4)  # -> flatten(Brep)
cap_holes_2 = CapHoles(Brep=pipe_2)  # -> flatten(Brep)
cap_holes_3 = CapHoles(Brep=pipe)  # -> flatten(Brep)
cap_holes_4 = CapHoles(Brep=pipe_3)  # -> flatten(Brep)
merge = Merge(Data1=cap_holes, Data2=cap_holes_2, Data3=cap_holes_3, Data4=cap_holes_4)
object_bake = ObjectBake(
    BakeToggle=Button(),
    GeometryObjects=merge,
    Layer="Hatch Pipes",
    ObjectName="GH_Obj",
    ObjectColor=RGB(255, 255, 255),
    LayerColor=RGB(255, 255, 255))

xy_plane_2 = XYPlane(Origin=[<geometry referenced from the Rhino model> x2])
unroll_polysurface_2 = UnrollPolysurface(Polysurface=brep_2, Plane=xy_plane_2)  # -> flatten(Unrolled), UnrolledPoints, UnrolledCurves
brep_join_2 = BrepJoin(Breps=unroll_polysurface_2.Unrolled)  # -> Breps, Closed
brep_edges_5 = BrepEdges(Brep=brep_join_2.Breps)  # -> Naked, Interior, NonManifold

curve_2 = Curve(brep_edges_5.Interior)

join_curves_3 = JoinCurves(Curves=[brep_edges_5.Naked, curve_2], Preserve=False)  # -> flatten(Curves)
list_item_10 = ListItem(List=join_curves_3, Index=Slider(3, range=0..10), Wrap=True)
panel_7 = Panel(join_curves_3)
boundary_surfaces_2 = BoundarySurfaces(Edges=join_curves_3)
surface_4 = Surface(boundary_surfaces_2)

bounding_box_2 = BoundingBox(Content=surface_4, Plane=PlaneXY(0, 0, 0))  # -> Box, Box_2
brep_edges_6 = BrepEdges(Brep=bounding_box_2.Box)  # -> Naked, Interior, NonManifold
panel_8 = Panel(brep_edges_6.Naked)
join_curves_4 = JoinCurves(Curves=flatten(brep_edges_6.Naked), Preserve=False)
offset_curve_2 = OffsetCurve(Curve=join_curves_4, Distance=Slider(4.32, range=0..10), Plane=xy_plane_2, Corners=1)

# ---- group: Hatch 1
number_slider_6 = Slider(0, range=0..13)
brep_edges_7 = BrepEdges(Brep=offset_curve_2)  # -> flatten(Naked), Interior, NonManifold
addition_4 = Addition(A=number_slider_6, B=1)
list_item_11 = ListItem(List=brep_edges_7.Naked, Index=number_slider_6, Wrap=True)
panel_9 = Panel(brep_edges_7.Naked)
number_slider_7 = Slider(0.3, range=0..10)
list_item_12 = ListItem(List=brep_edges_7.Naked, Index=addition_4, Wrap=True)
length_4 = Length(Curve=list_item_12)
unit_vector_4 = UnitVector(Vector=list_item_12)
divide_length_4 = DivideLength(Curve=list_item_11, Length=number_slider_7)  # -> Points, Tangents, Parameters
line_sdl_4 = LineSDL(Start=divide_length_4.Points, Direction=unit_vector_4, Length=length_4)
hatch_angle_4 = Slider(45, range=0..100)
point_on_curve_4 = PointOnCurve(line_sdl_4, parameter=0.5)
deconstruct_brep_5 = DeconstructBrep(Brep=brep_join_2.Breps)  # -> simplify(graft(Faces)), Edges, Vertices
rotate_4 = Rotate(Geometry=line_sdl_4, Angle=degrees(hatch_angle_4), Plane=point_on_curve_4)  # -> Geometry, Transform
explode_tree_5 = ExplodeTree(Data=deconstruct_brep_5.Faces)  # -> Branch0, Branch1, Branch2, Branch3, Branch4
panel_10 = Panel(deconstruct_brep_5.Faces)
project_curve_5 = ProjectCurve(Curve=rotate_4.Geometry, Brep=explode_tree_5.Branch0, Direction=Vector(0, 0, 1))

number_slider_8 = Slider(4, range=0..13)
addition_5 = Addition(A=number_slider_8, B=1)
list_item_13 = ListItem(List=brep_edges_7.Naked, Index=number_slider_8, Wrap=True)
list_item_14 = ListItem(List=brep_edges_7.Naked, Index=addition_5, Wrap=True)
length_5 = Length(Curve=list_item_14)
unit_vector_5 = UnitVector(Vector=list_item_14)
divide_length_5 = DivideLength(Curve=list_item_13, Length=Slider(0.3, range=0..10))  # -> Points, Tangents, Parameters
line_sdl_5 = LineSDL(Start=divide_length_5.Points, Direction=unit_vector_5, Length=length_5)
hatch_angle_5 = Slider(45, range=0..100)
point_on_curve_5 = PointOnCurve(line_sdl_5, parameter=0.5)
rotate_5 = Rotate(Geometry=line_sdl_5, Angle=degrees(hatch_angle_5), Plane=point_on_curve_5)  # -> Geometry, Transform
deconstruct_brep_6 = DeconstructBrep(Brep=brep_join_2.Breps)  # -> Faces, Edges, Vertices
explode_tree_6 = ExplodeTree(Data=deconstruct_brep_6.Faces)  # -> Branch0, Branch1, Branch2, Branch3, Branch4
project_curve_6 = ProjectCurve(Curve=rotate_5.Geometry, Brep=explode_tree_6.Branch1, Direction=Vector(0, 0, 1))

# ----
surface_5 = Surface(explode_tree_5.Branch0)
deconstruct_brep_7 = DeconstructBrep(Brep=brep_2)  # -> Faces, Edges, Vertices
surface_6 = Surface(explode_tree_6.Branch1)
reverse_surface_direction_3 = ReverseSurfaceDirection(Surface=surface_6, ReverseOption=Slider(2, range=0..10))
reverse_surface_direction_4 = ReverseSurfaceDirection(Surface=surface_5, ReverseOption=Slider(2, range=0..10))
explode_tree_7 = ExplodeTree(Data=deconstruct_brep_7.Faces)  # -> Branch0, Branch1, Branch2, Branch3, Branch4
number_slider_9 = Slider(0.45, range=0..1)
number_slider_10 = Slider(0.45, range=0..1)
map_to_surface_5 = MapToSurface(Curve=project_curve_6, Source=reverse_surface_direction_3, Target=explode_tree_7.Branch1)
map_to_surface_6 = MapToSurface(Curve=project_curve_5, Source=reverse_surface_direction_4, Target=explode_tree_7.Branch0)
extend_curve_5 = ExtendCurve(Curve=map_to_surface_6, Type=0, Start=number_slider_9, End=number_slider_9)
extend_curve_6 = ExtendCurve(Curve=map_to_surface_5, Type=0, Start=number_slider_10, End=number_slider_10)
rebuild_curve_5 = RebuildCurve(Curve=extend_curve_6, Degree=1, Count=2, Tangents=False)
rebuild_curve_6 = RebuildCurve(Curve=extend_curve_5, Degree=1, Count=2, Tangents=False)

number_5 = Number(number_slider_7)
number_6 = Number(number_slider_7)
division_5 = Division(A=number_5, B=Slider(6, range=2..6))
division_6 = Division(A=number_6, B=Slider(6, range=2..6))
pipe_5 = Pipe(Curve=rebuild_curve_5, Radius=division_5, Caps=1)
pipe_6 = Pipe(Curve=rebuild_curve_6, Radius=division_6, Caps=1)
cap_holes_5 = CapHoles(Brep=pipe_6)  # -> flatten(Brep)
cap_holes_6 = CapHoles(Brep=pipe_5)  # -> flatten(Brep)
merge_2 = Merge(Data1=cap_holes_5, Data2=cap_holes_6)
object_bake_2 = ObjectBake(
    BakeToggle=Button(),
    GeometryObjects=merge_2,
    Layer="Hatch Pipes",
    ObjectName="GH_Obj",
    ObjectColor=RGB(255, 255, 255),
    LayerColor=RGB(255, 255, 255))
