# Grasshopper definition Assignment 3_Void model to sheets.gh (Grasshopper 1.0.8)
# plug-ins: treesloth01, Pufferfish, Human, opennest_2 Info, LunchBox

font_size = Number()
font = Integer()
y_brep = Brep()
font_size_2 = Number(font_size)
font_2 = Integer(font)
z_brep = Brep()
x_brep = Brep()
void_model = Brep()
thickness_2 = Number()
cluster = Cluster(void_model=<geometry referenced from the Rhino model>, thickness_2=Slider(0.03, range=0..1), boolean=Button())  # -> x_sheets_2, y_sheets_2, z_sheets_2
list_length = ListLength(List=cluster.z_sheets_2)
list_length_2 = ListLength(List=cluster.y_sheets_2)
list_length_3 = ListLength(List=cluster.x_sheets_2)
panel = Panel(list_length)
panel_2 = Panel(list_length_3)
panel_3 = Panel(list_length_2)
custom_preview_materials = CustomPreviewMaterials(Geometry=cluster.z_sheets_2, DiffuseColor=ColourSwatch(SwatchColor=RGB(244, 255, 94)))
custom_preview_materials_2 = CustomPreviewMaterials(Geometry=cluster.y_sheets_2, DiffuseColor=ColourSwatch(SwatchColor=RGB(167, 112, 230)))
custom_preview_materials_3 = CustomPreviewMaterials(Geometry=cluster.x_sheets_2, DiffuseColor=ColourSwatch(SwatchColor=RGB(129, 214, 186)))
x_brep_2 = Brep([<brep referenced from the Rhino model> x10])
y_brep_2 = Brep([<brep referenced from the Rhino model> x11])
z_brep_2 = Brep([<brep referenced from the Rhino model> x15])
cluster_2 = Cluster_2(
    x_brep=x_brep_2,
    y_brep=y_brep_2,
    z_brep=z_brep_2,
    font_size=Slider(0.37, range=0..1),
    font_size_2=Slider(47, range=0..100))  # -> nested_surface_2, nested_text_curve_2, _3d_text_curve_2
custom_preview = CustomPreview(Geometry=cluster_2._3d_text_curve_2, Material=ColourSwatch(SwatchColor=RGB(0, 0, 0)))
surface = Surface(cluster_2.nested_surface_2)
panel_4 = Panel(cluster_2.nested_text_curve_2)

# ---- group: Alienate Untrimmed Surface
panel_5 = Panel(surface)
member_index = MemberIndex(Set=panel_5, Member="Untrimmed Surface")  # -> Index, Count
panel_6 = Panel(member_index.Index)
cull_index = CullIndex(List=surface, Indices=member_index.Index, Wrap=True)
panel_7 = Panel(cull_index)

# ----
list_item = ListItem(List=surface, Index=member_index.Index, Wrap=True)

c_script = CSharpScript(S=surface)  # -> out, A; inputs S: Surface
# ---------- c_script: C# ----------
using Rhino;
using Rhino.Geometry;

public class Script_Instance : GH_ScriptInstance
{
  private void RunScript(Surface S, ref object A)
  {
    if (S == null)
    {
      A = "null";
      return;
    }

    // Check if surface is a BrepFace (trimmed) or pure Surface
    Brep brep = S.ToBrep();
    if (brep == null)
    {
      A = "untrimmed";
      return;
    }

    // If there are trims, it's trimmed
    bool trimmed = false;
    foreach (var face in brep.Faces)
    {
      if (face.Loops.Count > 1) // more than outer loop
      {
        trimmed = true;
        break;
      }
    }

    A = trimmed ? "trimmed" : "untrimmed";
  }
}
# ---------- end c_script ----------
panel_8 = Panel(c_script.A)

deconstruct_brep = DeconstructBrep(Brep=list_item)  # -> Faces, Edges, Vertices
join_curves = JoinCurves(Curves=deconstruct_brep.Edges, Preserve=False)  # -> flatten(Curves)
panel_9 = Panel(join_curves)
brep_edges = BrepEdges(Brep=cull_index)  # -> Naked, Interior, NonManifold
join_curves_2 = JoinCurves(Curves=brep_edges.Naked, Preserve=False)  # -> flatten(Curves)
merge = Merge(Data1=join_curves_2, Data2=join_curves)  # -> flatten(Result)
curve = Curve([<curve referenced from the Rhino model> x3])
unit_z = UnitZ(Factor=expr("-x", Slider(0.06, range=0..0.1)))
opennest1 = OpenNest1(
    Sheets=curve,
    Geo=merge,
    Spacing=Slider(0, range=0..4),
    Placement=Slider(0, range=0..10),
    Tolerance=Slider(0.18, range=0..10),
    Rotations=Slider(4, range=0..6),
    Iterations=1,
    Seed=Slider(2, range=0..6),
    Reset=True,
    Run=Toggle(True))  # -> Sheets, Geo, ID, Transform, IDS
panel_10 = Panel("""X Face
Y Face
Z Face""")
transform = Transform(Geometry=cluster_2.nested_text_curve_2, Transform=graft(opennest1.Transform))  # -> simplify(Geometry)
curve_2 = Curve(opennest1.Geo)
boundary_surfaces = BoundarySurfaces(Edges=curve_2)
graft_tree = GraftTree(Tree=panel_10, IncludeEmptyLists=True, IncludeNullItems=True)
boolean = Boolean()
panel_11 = Panel(curve_2)
simplify_curve = SimplifyCurve(Curve=curve_2)  # -> Curve, Simplified
panel_12 = Panel("""X Face
Y Face
Z Face""")
list_length_4 = ListLength(List=transform)  # -> flatten(Length)
boolean_2 = Boolean(boolean)
graft_tree_2 = GraftTree(Tree=panel_12, IncludeEmptyLists=True, IncludeNullItems=True)
stack_trees = StackTrees(Data0=opennest1.Sheets, Data1=simplify_curve.Curve, Data2=transform, Reduce=True)
panel_13 = Panel(list_length_4)
panel_14 = Panel("""Sheet Boundary
Unroll Faces
Unroll Tags""")
graft_tree_3 = GraftTree(Tree=panel_14, IncludeEmptyLists=True, IncludeNullItems=True)
object_bake = ObjectBake(
    BakeToggle=Button(),
    GeometryObjects=stack_trees,
    Layer=graft_tree_3,
    ObjectName="GH_Obj",
    ObjectColor=RGB(255, 255, 255),
    LayerColor=RGB(255, 255, 255))
boolean_toggle = BooleanToggle(True)
boolean_toggle_2 = BooleanToggle(True)
panel_15 = Panel("""3
4
5
7
9""")

# ---- group: Y Sheets Unrolled
y_brep_3 = Brep(y_brep)
panel_16 = Panel(y_brep_3)
deconstruct_brep_2 = DeconstructBrep(Brep=y_brep_3)  # -> Faces, Edges, Vertices
area = Area(Geometry=deconstruct_brep_2.Faces)  # -> Area, Centroid
sort_list = SortList(Keys=area.Area, ValuesValuesA=deconstruct_brep_2.Faces)  # -> Keys, ValuesValuesA
panel_17 = Panel(deconstruct_brep_2.Faces)
panel_18 = Panel(sort_list.Keys)
first_last = FirstLast(List=sort_list.ValuesValuesA)  # -> FirstValue, LastValue
surface_2 = Surface(flatten(first_last.LastValue))
brep_edges_2 = BrepEdges(Brep=surface_2)  # -> Naked, Interior, NonManifold
join_curves_3 = JoinCurves(Curves=brep_edges_2.Naked, Preserve=False)  # -> flatten(Curves)
evaluate_surface = EvaluateSurface(Surface=reparameterize(surface_2), Point="0.5,0.5")  # -> Point, Normal, UDirection, VDirection, Frame
panel_19 = Panel(join_curves_3)
number_slider = Slider(0.724, range=0..10)
number_slider_2 = Slider(47, range=0..100)
font_table = FontTable()
list_item_2 = ListItem(List=font_table, Index=font_2, Wrap=True)

# ---- group: Y Sheets Unrolled / Center 1
number_slider_3 = Slider(10, range=0..10)
list_item_3 = ListItem(List=join_curves_3, Index=number_slider_3, Wrap=True)
boundary_surfaces_2 = BoundarySurfaces(Edges=list_item_3)
evaluate_surface_2 = EvaluateSurface(Surface=reparameterize(boundary_surfaces_2), Point="0.5, 0.5")  # -> Point, Normal, UDirection, VDirection, Frame
plane_normal = PlaneNormal(Origin=evaluate_surface_2.Point, ZAxis=evaluate_surface_2.Normal)  # -> flatten(Plane)
offset_curve = OffsetCurve(Curve=flatten(list_item_3), Distance=Slider(-0.899, range=-1..1), Plane=plane_normal, Corners=1)
polygon_center = PolygonCenter(Polyline=offset_curve)  # -> CenterV, CenterE, CenterA
point = Point(polygon_center.CenterA)

# ---- group: Y Sheets Unrolled (continued)
cull_index_2 = CullIndex(List=join_curves_3, Indices=number_slider_3, Wrap=True)
polygon_center_2 = PolygonCenter(Polyline=cull_index_2)  # -> CenterV, CenterE, CenterA
point_2 = Point(polygon_center_2.CenterA)
merge_2 = Merge(Data1=point_2, Data2=point)
plane_normal_2 = PlaneNormal(Origin=merge_2, ZAxis=evaluate_surface.Normal)
align_planes = AlignPlanes(Planes=plane_normal_2)
list_length_5 = ListLength(List=align_planes)
panel_20 = Panel(list_length_5)
series = Series(Start=1, Step=1, Count=list_length_5)
concatenate = Concatenate(FragmentA="Y-", FragmentB=series)
panel_21 = Panel(concatenate)
text = Text(Location=align_planes, Text=concatenate, Size=font_size_2, Font=list_item_2)
unroll_polysurface = UnrollPolysurface(Polysurface=graft(surface_2), Curves=text)  # -> flatten(Unrolled), UnrolledPoints, UnrolledCurves

# ---- group: X Sheets Unrolled
x_brep_3 = Brep(x_brep)
panel_22 = Panel(x_brep_3)
deconstruct_brep_3 = DeconstructBrep(Brep=x_brep_3)  # -> Faces, Edges, Vertices
area_2 = Area(Geometry=deconstruct_brep_3.Faces)  # -> Area, Centroid
sort_list_2 = SortList(Keys=area_2.Area, ValuesValuesA=deconstruct_brep_3.Faces)  # -> Keys, ValuesValuesA
panel_23 = Panel(deconstruct_brep_3.Faces)
panel_24 = Panel(sort_list_2.Keys)
first_last_2 = FirstLast(List=sort_list_2.ValuesValuesA)  # -> FirstValue, LastValue
surface_3 = Surface(flatten(first_last_2.LastValue))
brep_edges_3 = BrepEdges(Brep=surface_3)  # -> Naked, Interior, NonManifold
join_curves_4 = JoinCurves(Curves=brep_edges_3.Naked, Preserve=False)  # -> flatten(Curves)
evaluate_surface_3 = EvaluateSurface(Surface=reparameterize(surface_3), Point="0.5,0.5")  # -> Point, Normal, UDirection, VDirection, Frame
panel_25 = Panel(join_curves_4)
number_slider_4 = Slider(0.724, range=0..10)
number_slider_5 = Slider(47, range=0..100)
font_table_2 = FontTable()
list_item_4 = ListItem(List=font_table_2, Index=font_2, Wrap=True)

# ---- group: X Sheets Unrolled / Center 1
number_slider_6 = Slider(10, range=0..10)
list_item_5 = ListItem(List=join_curves_4, Index=number_slider_6, Wrap=True)
boundary_surfaces_3 = BoundarySurfaces(Edges=list_item_5)
evaluate_surface_4 = EvaluateSurface(Surface=reparameterize(boundary_surfaces_3), Point="0.5, 0.5")  # -> Point, Normal, UDirection, VDirection, Frame
plane_normal_3 = PlaneNormal(Origin=evaluate_surface_4.Point, ZAxis=evaluate_surface_4.Normal)  # -> flatten(Plane)
offset_curve_2 = OffsetCurve(Curve=flatten(list_item_5), Distance=Slider(-0.899, range=-1..1), Plane=plane_normal_3, Corners=1)
polygon_center_3 = PolygonCenter(Polyline=offset_curve_2)  # -> CenterV, CenterE, CenterA
point_3 = Point(polygon_center_3.CenterA)

# ---- group: X Sheets Unrolled (continued)
cull_index_3 = CullIndex(List=join_curves_4, Indices=number_slider_6, Wrap=True)
polygon_center_4 = PolygonCenter(Polyline=cull_index_3)  # -> CenterV, CenterE, CenterA
point_4 = Point(polygon_center_4.CenterA)
merge_3 = Merge(Data1=point_4, Data2=point_3)
plane_normal_4 = PlaneNormal(Origin=merge_3, ZAxis=evaluate_surface_3.Normal)
align_planes_2 = AlignPlanes(Planes=plane_normal_4)
list_length_6 = ListLength(List=align_planes_2)
panel_26 = Panel(list_length_6)
series_2 = Series(Start=1, Step=1, Count=list_length_6)
concatenate_2 = Concatenate(FragmentA="X-", FragmentB=series_2)
panel_27 = Panel(concatenate_2)
text_2 = Text(Location=align_planes_2, Text=concatenate_2, Size=font_size_2, Font=list_item_4)
unroll_polysurface_2 = UnrollPolysurface(Polysurface=graft(surface_3), Curves=text_2)  # -> flatten(Unrolled), UnrolledPoints, UnrolledCurves

# ---- group: Z Sheets Unrolled
z_brep_3 = Brep(z_brep)
panel_28 = Panel(z_brep_3)
deconstruct_brep_4 = DeconstructBrep(Brep=z_brep_3)  # -> Faces, Edges, Vertices
area_3 = Area(Geometry=deconstruct_brep_4.Faces)  # -> Area, Centroid
sort_list_3 = SortList(Keys=area_3.Area, ValuesValuesA=deconstruct_brep_4.Faces)  # -> Keys, ValuesValuesA
panel_29 = Panel(deconstruct_brep_4.Faces)
panel_30 = Panel(sort_list_3.Keys)
first_last_3 = FirstLast(List=sort_list_3.ValuesValuesA)  # -> FirstValue, LastValue
surface_4 = Surface(flatten(first_last_3.LastValue))
brep_edges_4 = BrepEdges(Brep=surface_4)  # -> Naked, Interior, NonManifold
join_curves_5 = JoinCurves(Curves=brep_edges_4.Naked, Preserve=False)  # -> flatten(Curves)
evaluate_surface_5 = EvaluateSurface(Surface=reparameterize(surface_4), Point="0.5,0.5")  # -> Point, Normal, UDirection, VDirection, Frame
panel_31 = Panel(join_curves_5)
number_slider_7 = Slider(0.724, range=0..10)
number_slider_8 = Slider(47, range=0..100)
font_table_3 = FontTable()
list_item_6 = ListItem(List=font_table_3, Index=font_2, Wrap=True)

# ---- group: Z Sheets Unrolled / Center 1
number_slider_9 = Slider(10, range=0..10)
list_item_7 = ListItem(List=join_curves_5, Index=number_slider_9, Wrap=True)
boundary_surfaces_4 = BoundarySurfaces(Edges=list_item_7)
evaluate_surface_6 = EvaluateSurface(Surface=reparameterize(boundary_surfaces_4), Point="0.5, 0.5")  # -> Point, Normal, UDirection, VDirection, Frame
plane_normal_5 = PlaneNormal(Origin=evaluate_surface_6.Point, ZAxis=evaluate_surface_6.Normal)  # -> flatten(Plane)
offset_curve_3 = OffsetCurve(Curve=flatten(list_item_7), Distance=Slider(-0.899, range=-1..1), Plane=plane_normal_5, Corners=1)
polygon_center_5 = PolygonCenter(Polyline=offset_curve_3)  # -> CenterV, CenterE, CenterA
point_5 = Point(polygon_center_5.CenterA)

# ---- group: Z Sheets Unrolled (continued)
cull_index_4 = CullIndex(List=join_curves_5, Indices=number_slider_9, Wrap=True)
polygon_center_6 = PolygonCenter(Polyline=cull_index_4)  # -> CenterV, CenterE, CenterA
point_6 = Point(polygon_center_6.CenterA)
merge_4 = Merge(Data1=point_6, Data2=point_5)
plane_normal_6 = PlaneNormal(Origin=merge_4, ZAxis=evaluate_surface_5.Normal)
align_planes_3 = AlignPlanes(Planes=plane_normal_6)
list_length_7 = ListLength(List=align_planes_3)
panel_32 = Panel(list_length_7)
series_3 = Series(Start=1, Step=1, Count=list_length_7)
concatenate_3 = Concatenate(FragmentA="Z-", FragmentB=series_3)
panel_33 = Panel(concatenate_3)
text_3 = Text(Location=align_planes_3, Text=concatenate_3, Size=font_size_2, Font=list_item_6)
unroll_polysurface_3 = UnrollPolysurface(Polysurface=graft(surface_4), Curves=text_3)  # -> flatten(Unrolled), UnrolledPoints, UnrolledCurves

# ----
merge_5 = Merge(Data1=unroll_polysurface_2.Unrolled, Data2=unroll_polysurface.Unrolled, Data3=unroll_polysurface_3.Unrolled)
stack_trees_2 = StackTrees(
    Data0=unroll_polysurface_2.UnrolledCurves,
    Data1=unroll_polysurface.UnrolledCurves,
    Data2=unroll_polysurface_3.UnrolledCurves,
    Reduce=True)
stack_trees_3 = StackTrees(Data0=text_2, Data1=text, Data2=text_3, Reduce=True)
nested_surface = Surface(merge_5)
nested_text_curve = Curve(stack_trees_2)
_3d_text_curve = Curve(stack_trees_3)
nested_surface_2 = Surface(nested_surface)
nested_text_curve_2 = Curve(nested_text_curve)
_3d_text_curve_2 = Curve(_3d_text_curve)

# ---- group: Thicken Sheets
void_model_2 = Brep(<brep referenced from the Rhino model>)
deconstruct_brep_5 = DeconstructBrep(Brep=void_model_2)  # -> Faces, Edges, Vertices
evaluate_surface_7 = EvaluateSurface(Surface=reparameterize(deconstruct_brep_5.Faces), Point="0.5,0.5")  # -> Point, Normal, UDirection, VDirection, Frame
plane_normal_7 = PlaneNormal(Origin=evaluate_surface_7.Point, ZAxis=evaluate_surface_7.Normal)
deconstruct_plane = DeconstructPlane(Plane=plane_normal_7)  # -> Origin, XAxis, YAxis, ZAxisTheNormalFacePerpendicularToTheOriginPlan
deconstruct_vector = DeconstructVector(Vector=deconstruct_plane.ZAxisTheNormalFacePerpendicularToTheOriginPlan)  # -> XComponent, YComponent, ZComponent
panel_34 = Panel(deconstruct_vector.ZComponent)
round = Round(Number=deconstruct_vector.XComponent)  # -> Nearest, Floor, Ceiling
round_2 = Round(Number=deconstruct_vector.YComponent)  # -> Nearest, Floor, Ceiling
round_3 = Round(Number=deconstruct_vector.ZComponent)  # -> Nearest, Floor, Ceiling
thickness_2_2 = Number(Slider(0.03, range=0..1))
negative = Negative(Value=thickness_2_2)

# ---- group: Thicken Sheets / Get rid of any negative value
absolute = Absolute(Value=round.Nearest)
absolute_2 = Absolute(Value=round_3.Nearest)
absolute_3 = Absolute(Value=round_2.Nearest)

# ---- group: Thicken Sheets (continued)
panel_35 = Panel(absolute)
larger_than = LargerThan(FirstNumber=absolute, SecondNumber=0)  # -> LargerThan, OrEqualTo
larger_than_2 = LargerThan(FirstNumber=absolute_2, SecondNumber=0)  # -> LargerThan, OrEqualTo
larger_than_3 = LargerThan(FirstNumber=absolute_3, SecondNumber=0)  # -> LargerThan, OrEqualTo
panel_36 = Panel(larger_than.LargerThan)
cull_pattern = CullPattern(List=deconstruct_brep_5.Faces, CullPattern=larger_than.LargerThan)
cull_pattern_2 = CullPattern(List=deconstruct_brep_5.Faces, CullPattern=larger_than_3.LargerThan)
cull_pattern_3 = CullPattern(List=deconstruct_brep_5.Faces, CullPattern=larger_than_2.LargerThan)
offset_surface = OffsetSurface(Surface=cull_pattern, Distance=negative, BothSides=thickness_2_2, CreateSolid=True)  # -> flatten(Offset)
offset_surface_2 = OffsetSurface(Surface=cull_pattern_3, Distance=negative, BothSides=thickness_2_2, CreateSolid=True)  # -> flatten(Offset)
offset_surface_3 = OffsetSurface(Surface=cull_pattern_2, Distance=negative, BothSides=thickness_2_2, CreateSolid=True)  # -> flatten(Offset)

# ----
deconstruct_brep_6 = DeconstructBrep(Brep=offset_surface)  # -> Faces, Edges, Vertices
evaluate_surface_8 = EvaluateSurface(Surface=reparameterize(deconstruct_brep_6.Faces), Point="0.5,0.5")  # -> Point, Normal, UDirection, VDirection, Frame
deconstruct_vector_2 = DeconstructVector(Vector=evaluate_surface_8.Normal)  # -> XComponent, YComponent, ZComponent
equality = Equality(FirstNumber=deconstruct_vector_2.ZComponent, SecondNumber=1)  # -> Equality, Inequality
equality_2 = Equality(FirstNumber=deconstruct_vector_2.ZComponent, SecondNumber=-1)  # -> Equality, Inequality
number = Number(thickness_2_2)
cull_pattern_4 = CullPattern(List=deconstruct_brep_6.Faces, CullPattern=equality.Equality)
cull_pattern_5 = CullPattern(List=deconstruct_brep_6.Faces, CullPattern=equality_2.Equality)
unit_z_2 = UnitZ(Factor=number)
panel_37 = Panel(cull_pattern_4)
negative_2 = Negative(Value=unit_z_2)
extrude = Extrude(Base=cull_pattern_4, Direction=unit_z_2)  # -> flatten(Extrusion)
extrude_2 = Extrude(Base=cull_pattern_5, Direction=negative_2)  # -> flatten(Extrusion)
panel_38 = Panel(extrude)
solid_union = SolidUnion(Breps=[extrude, extrude_2, offset_surface])
merge_faces = MergeFaces(Brep=solid_union)  # -> Breps, Before, After
deconstruct_brep_7 = DeconstructBrep(Brep=merge_faces.Breps)  # -> Faces, Edges, Vertices
evaluate_surface_9 = EvaluateSurface(Surface=reparameterize(deconstruct_brep_7.Faces), Point="0.5,0.5")  # -> Point, Normal, UDirection, VDirection, Frame
deconstruct_vector_3 = DeconstructVector(Vector=evaluate_surface_9.Normal)  # -> XComponent, YComponent, ZComponent
equality_3 = Equality(FirstNumber=deconstruct_vector_3.YComponent, SecondNumber=1)  # -> Equality, Inequality
equality_4 = Equality(FirstNumber=deconstruct_vector_3.YComponent, SecondNumber=-1)  # -> Equality, Inequality
number_2 = Number(number)
cull_pattern_6 = CullPattern(List=deconstruct_brep_7.Faces, CullPattern=equality_3.Equality)
cull_pattern_7 = CullPattern(List=deconstruct_brep_7.Faces, CullPattern=equality_4.Equality)
unit_y = UnitY(Factor=number_2)
panel_39 = Panel(cull_pattern_6)
negative_3 = Negative(Value=unit_y)
extrude_3 = Extrude(Base=cull_pattern_6, Direction=unit_y)  # -> flatten(Extrusion)
extrude_4 = Extrude(Base=cull_pattern_7, Direction=negative_3)  # -> flatten(Extrusion)
panel_40 = Panel(extrude_3)
solid_union_2 = SolidUnion(Breps=[extrude_3, extrude_4, merge_faces.Breps])
merge_faces_2 = MergeFaces(Brep=solid_union_2)  # -> Breps, Before, After

deconstruct_brep_8 = DeconstructBrep(Brep=offset_surface_2)  # -> Faces, Edges, Vertices
evaluate_surface_10 = EvaluateSurface(Surface=reparameterize(deconstruct_brep_8.Faces), Point="0.5,0.5")  # -> Point, Normal, UDirection, VDirection, Frame
deconstruct_vector_4 = DeconstructVector(Vector=evaluate_surface_10.Normal)  # -> XComponent, YComponent, ZComponent
equality_5 = Equality(FirstNumber=deconstruct_vector_4.YComponent, SecondNumber=1)  # -> Equality, Inequality
equality_6 = Equality(FirstNumber=deconstruct_vector_4.YComponent, SecondNumber=-1)  # -> Equality, Inequality
number_3 = Number(thickness_2_2)
cull_pattern_8 = CullPattern(List=deconstruct_brep_8.Faces, CullPattern=equality_5.Equality)
cull_pattern_9 = CullPattern(List=deconstruct_brep_8.Faces, CullPattern=equality_6.Equality)
unit_y_2 = UnitY(Factor=number_3)
panel_41 = Panel(cull_pattern_8)
negative_4 = Negative(Value=unit_y_2)
extrude_5 = Extrude(Base=cull_pattern_8, Direction=unit_y_2)  # -> flatten(Extrusion)
extrude_6 = Extrude(Base=cull_pattern_9, Direction=negative_4)  # -> flatten(Extrusion)
solid_union_3 = SolidUnion(Breps=[extrude_5, extrude_6, offset_surface_2])
merge_faces_3 = MergeFaces(Brep=solid_union_3)  # -> Breps, Before, After

# ---- group: Z
solid_difference = SolidDifference(BrepsA=merge_faces_3.Breps, BrepsB=merge_faces_2.Breps)

# ----
x_sheets = Brep(merge_faces_2.Breps)
custom_preview_materials_4 = CustomPreviewMaterials(Geometry=x_sheets, DiffuseColor=ColourSwatch(SwatchColor=RGB(129, 214, 186)))

# ---- group: Thicken Sheets
void_model_3 = Brep(void_model)
deconstruct_brep_9 = DeconstructBrep(Brep=void_model_3)  # -> Faces, Edges, Vertices
evaluate_surface_11 = EvaluateSurface(Surface=reparameterize(deconstruct_brep_9.Faces), Point="0.5,0.5")  # -> Point, Normal, UDirection, VDirection, Frame
plane_normal_8 = PlaneNormal(Origin=evaluate_surface_11.Point, ZAxis=evaluate_surface_11.Normal)
deconstruct_plane_2 = DeconstructPlane(Plane=plane_normal_8)  # -> Origin, XAxis, YAxis, ZAxisTheNormalFacePerpendicularToTheOriginPlan
deconstruct_vector_5 = DeconstructVector(Vector=deconstruct_plane_2.ZAxisTheNormalFacePerpendicularToTheOriginPlan)  # -> XComponent, YComponent, ZComponent
panel_42 = Panel(deconstruct_vector_5.ZComponent)
round_4 = Round(Number=deconstruct_vector_5.XComponent)  # -> Nearest, Floor, Ceiling
round_5 = Round(Number=deconstruct_vector_5.YComponent)  # -> Nearest, Floor, Ceiling
round_6 = Round(Number=deconstruct_vector_5.ZComponent)  # -> Nearest, Floor, Ceiling
number_slider_10 = Slider(0.03, range=0..1)
thickness_2_3 = Number(thickness_2)
negative_5 = Negative(Value=thickness_2_3)

# ---- group: Thicken Sheets / Get rid of any negative value
absolute_4 = Absolute(Value=round_4.Nearest)
absolute_5 = Absolute(Value=round_6.Nearest)
absolute_6 = Absolute(Value=round_5.Nearest)

# ---- group: Thicken Sheets (continued)
panel_43 = Panel(absolute_4)
larger_than_4 = LargerThan(FirstNumber=absolute_4, SecondNumber=0)  # -> LargerThan, OrEqualTo
larger_than_5 = LargerThan(FirstNumber=absolute_5, SecondNumber=0)  # -> LargerThan, OrEqualTo
larger_than_6 = LargerThan(FirstNumber=absolute_6, SecondNumber=0)  # -> LargerThan, OrEqualTo
panel_44 = Panel(larger_than_4.LargerThan)
cull_pattern_10 = CullPattern(List=deconstruct_brep_9.Faces, CullPattern=larger_than_4.LargerThan)
cull_pattern_11 = CullPattern(List=deconstruct_brep_9.Faces, CullPattern=larger_than_6.LargerThan)
cull_pattern_12 = CullPattern(List=deconstruct_brep_9.Faces, CullPattern=larger_than_5.LargerThan)
offset_surface_4 = OffsetSurface(Surface=cull_pattern_10, Distance=negative_5, BothSides=thickness_2_3, CreateSolid=True)  # -> flatten(Offset)
offset_surface_5 = OffsetSurface(Surface=cull_pattern_12, Distance=negative_5, BothSides=thickness_2_3, CreateSolid=True)  # -> flatten(Offset)
offset_surface_6 = OffsetSurface(Surface=cull_pattern_11, Distance=negative_5, BothSides=thickness_2_3, CreateSolid=True)  # -> flatten(Offset)

# ----
deconstruct_brep_10 = DeconstructBrep(Brep=offset_surface_4)  # -> Faces, Edges, Vertices
evaluate_surface_12 = EvaluateSurface(Surface=reparameterize(deconstruct_brep_10.Faces), Point="0.5,0.5")  # -> Point, Normal, UDirection, VDirection, Frame
deconstruct_vector_6 = DeconstructVector(Vector=evaluate_surface_12.Normal)  # -> XComponent, YComponent, ZComponent
equality_7 = Equality(FirstNumber=deconstruct_vector_6.ZComponent, SecondNumber=1)  # -> Equality, Inequality
equality_8 = Equality(FirstNumber=deconstruct_vector_6.ZComponent, SecondNumber=-1)  # -> Equality, Inequality
number_4 = Number(thickness_2_3)
cull_pattern_13 = CullPattern(List=deconstruct_brep_10.Faces, CullPattern=equality_7.Equality)
cull_pattern_14 = CullPattern(List=deconstruct_brep_10.Faces, CullPattern=equality_8.Equality)
unit_z_3 = UnitZ(Factor=number_4)
panel_45 = Panel(cull_pattern_13)
negative_6 = Negative(Value=unit_z_3)
extrude_7 = Extrude(Base=cull_pattern_13, Direction=unit_z_3)  # -> flatten(Extrusion)
extrude_8 = Extrude(Base=cull_pattern_14, Direction=negative_6)  # -> flatten(Extrusion)
panel_46 = Panel(extrude_7)
solid_union_4 = SolidUnion(Breps=[extrude_7, extrude_8, offset_surface_4])
merge_faces_4 = MergeFaces(Brep=solid_union_4)  # -> Breps, Before, After
deconstruct_brep_11 = DeconstructBrep(Brep=merge_faces_4.Breps)  # -> Faces, Edges, Vertices
evaluate_surface_13 = EvaluateSurface(Surface=reparameterize(deconstruct_brep_11.Faces), Point="0.5,0.5")  # -> Point, Normal, UDirection, VDirection, Frame
deconstruct_vector_7 = DeconstructVector(Vector=evaluate_surface_13.Normal)  # -> XComponent, YComponent, ZComponent
equality_9 = Equality(FirstNumber=deconstruct_vector_7.YComponent, SecondNumber=1)  # -> Equality, Inequality
equality_10 = Equality(FirstNumber=deconstruct_vector_7.YComponent, SecondNumber=-1)  # -> Equality, Inequality
number_5 = Number(number_4)
cull_pattern_15 = CullPattern(List=deconstruct_brep_11.Faces, CullPattern=equality_9.Equality)
cull_pattern_16 = CullPattern(List=deconstruct_brep_11.Faces, CullPattern=equality_10.Equality)
unit_y_3 = UnitY(Factor=number_5)
panel_47 = Panel(cull_pattern_15)
negative_7 = Negative(Value=unit_y_3)
extrude_9 = Extrude(Base=cull_pattern_15, Direction=unit_y_3)  # -> flatten(Extrusion)
extrude_10 = Extrude(Base=cull_pattern_16, Direction=negative_7)  # -> flatten(Extrusion)
panel_48 = Panel(extrude_9)
solid_union_5 = SolidUnion(Breps=[extrude_9, extrude_10, merge_faces_4.Breps])
merge_faces_5 = MergeFaces(Brep=solid_union_5)  # -> Breps, Before, After

deconstruct_brep_12 = DeconstructBrep(Brep=offset_surface_5)  # -> Faces, Edges, Vertices
evaluate_surface_14 = EvaluateSurface(Surface=reparameterize(deconstruct_brep_12.Faces), Point="0.5,0.5")  # -> Point, Normal, UDirection, VDirection, Frame
deconstruct_vector_8 = DeconstructVector(Vector=evaluate_surface_14.Normal)  # -> XComponent, YComponent, ZComponent
equality_11 = Equality(FirstNumber=deconstruct_vector_8.YComponent, SecondNumber=1)  # -> Equality, Inequality
equality_12 = Equality(FirstNumber=deconstruct_vector_8.YComponent, SecondNumber=-1)  # -> Equality, Inequality
number_6 = Number(thickness_2_3)
cull_pattern_17 = CullPattern(List=deconstruct_brep_12.Faces, CullPattern=equality_11.Equality)
cull_pattern_18 = CullPattern(List=deconstruct_brep_12.Faces, CullPattern=equality_12.Equality)
unit_y_4 = UnitY(Factor=number_6)
panel_49 = Panel(cull_pattern_17)
negative_8 = Negative(Value=unit_y_4)
extrude_11 = Extrude(Base=cull_pattern_17, Direction=unit_y_4)  # -> flatten(Extrusion)
extrude_12 = Extrude(Base=cull_pattern_18, Direction=negative_8)  # -> flatten(Extrusion)
solid_union_6 = SolidUnion(Breps=[extrude_11, extrude_12, offset_surface_5])
merge_faces_6 = MergeFaces(Brep=solid_union_6)  # -> Breps, Before, After

brep = Brep(merge_faces_6.Breps)

deconstruct_brep_13 = DeconstructBrep(Brep=offset_surface_3)  # -> Faces, Edges, Vertices
evaluate_surface_15 = EvaluateSurface(Surface=reparameterize(deconstruct_brep_13.Faces), Point="0.5,0.5")  # -> Point, Normal, UDirection, VDirection, Frame
deconstruct_vector_9 = DeconstructVector(Vector=evaluate_surface_15.Normal)  # -> XComponent, YComponent, ZComponent
equality_13 = Equality(FirstNumber=deconstruct_vector_9.ZComponent, SecondNumber=1)  # -> Equality, Inequality
equality_14 = Equality(FirstNumber=deconstruct_vector_9.ZComponent, SecondNumber=-1)  # -> Equality, Inequality
number_7 = Number(thickness_2_2)
cull_pattern_19 = CullPattern(List=deconstruct_brep_13.Faces, CullPattern=equality_13.Equality)
cull_pattern_20 = CullPattern(List=deconstruct_brep_13.Faces, CullPattern=equality_14.Equality)
unit_z_4 = UnitZ(Factor=number_7)
panel_50 = Panel(cull_pattern_19)
negative_9 = Negative(Value=unit_z_4)
extrude_13 = Extrude(Base=cull_pattern_19, Direction=unit_z_4)  # -> flatten(Extrusion)
extrude_14 = Extrude(Base=cull_pattern_20, Direction=negative_9)  # -> flatten(Extrusion)
panel_51 = Panel(extrude_13)
solid_union_7 = SolidUnion(Breps=[extrude_13, extrude_14, offset_surface_3])
merge_faces_7 = MergeFaces(Brep=solid_union_7)  # -> Breps, Before, After
deconstruct_brep_14 = DeconstructBrep(Brep=merge_faces_7.Breps)  # -> Faces, Edges, Vertices
evaluate_surface_16 = EvaluateSurface(Surface=reparameterize(deconstruct_brep_14.Faces), Point="0.5,0.5")  # -> Point, Normal, UDirection, VDirection, Frame
deconstruct_vector_10 = DeconstructVector(Vector=evaluate_surface_16.Normal)  # -> XComponent, YComponent, ZComponent
equality_15 = Equality(FirstNumber=deconstruct_vector_10.XComponent, SecondNumber=1)  # -> Equality, Inequality
equality_16 = Equality(FirstNumber=deconstruct_vector_10.XComponent, SecondNumber=-1)  # -> Equality, Inequality
number_8 = Number(number_7)
cull_pattern_21 = CullPattern(List=deconstruct_brep_14.Faces, CullPattern=equality_15.Equality)
cull_pattern_22 = CullPattern(List=deconstruct_brep_14.Faces, CullPattern=equality_16.Equality)
panel_52 = Panel(cull_pattern_21)

unit_x = UnitX(Factor=number_8)

negative_10 = Negative(Value=unit_x)
extrude_15 = Extrude(Base=cull_pattern_21, Direction=unit_x)  # -> flatten(Extrusion)
extrude_16 = Extrude(Base=cull_pattern_22, Direction=negative_10)  # -> flatten(Extrusion)
panel_53 = Panel(extrude_15)
solid_union_8 = SolidUnion(Breps=[extrude_15, extrude_16, merge_faces_7.Breps])

# ---- group: Y
merge_faces_8 = MergeFaces(Brep=solid_union_8)  # -> Breps, Before, After

solid_difference_2 = SolidDifference(BrepsA=merge_faces_8.Breps, BrepsB=merge_faces_2.Breps)

# ----
deconstruct_brep_15 = DeconstructBrep(Brep=solid_difference_2)  # -> Faces, Edges, Vertices

# ---- group: Z
solid_difference_3 = SolidDifference(BrepsA=solid_difference, BrepsB=merge_faces_8.Breps)

# ----
panel_54 = Panel(deconstruct_brep_15.Faces)
list_item_8 = ListItem(List=deconstruct_brep_15.Faces, Index=Slider(20, range=0..100), Wrap=True)
z_sheets = Brep(solid_difference_3)
y_sheets = Brep(solid_difference_2)
extrude_17 = Extrude(Base=list_item_8, Direction=unit_z)

# ---- group: Keep Separted Branches
stack_trees_4 = StackTrees(Data0=x_sheets, Data1=y_sheets, Data2=z_sheets, Reduce=True)

# ----
object_bake_2 = ObjectBake(
    BakeToggle=False,
    GeometryObjects=stack_trees_4,
    Layer=graft_tree,
    ObjectName="GH_Obj",
    ObjectColor=RGB(255, 255, 255),
    LayerColor=RGB(255, 255, 255))
custom_preview_materials_5 = CustomPreviewMaterials(Geometry=z_sheets, DiffuseColor=ColourSwatch(SwatchColor=RGB(244, 255, 94)))
custom_preview_materials_6 = CustomPreviewMaterials(Geometry=y_sheets, DiffuseColor=ColourSwatch(SwatchColor=RGB(167, 112, 230)))

deconstruct_brep_16 = DeconstructBrep(Brep=offset_surface_6)  # -> Faces, Edges, Vertices
evaluate_surface_17 = EvaluateSurface(Surface=reparameterize(deconstruct_brep_16.Faces), Point="0.5,0.5")  # -> Point, Normal, UDirection, VDirection, Frame
deconstruct_vector_11 = DeconstructVector(Vector=evaluate_surface_17.Normal)  # -> XComponent, YComponent, ZComponent
equality_17 = Equality(FirstNumber=deconstruct_vector_11.ZComponent, SecondNumber=1)  # -> Equality, Inequality
equality_18 = Equality(FirstNumber=deconstruct_vector_11.ZComponent, SecondNumber=-1)  # -> Equality, Inequality
number_9 = Number(thickness_2_3)
cull_pattern_23 = CullPattern(List=deconstruct_brep_16.Faces, CullPattern=equality_17.Equality)
cull_pattern_24 = CullPattern(List=deconstruct_brep_16.Faces, CullPattern=equality_18.Equality)
unit_z_5 = UnitZ(Factor=number_9)
panel_55 = Panel(cull_pattern_23)
negative_11 = Negative(Value=unit_z_5)
extrude_18 = Extrude(Base=cull_pattern_23, Direction=unit_z_5)  # -> flatten(Extrusion)
extrude_19 = Extrude(Base=cull_pattern_24, Direction=negative_11)  # -> flatten(Extrusion)
panel_56 = Panel(extrude_18)
solid_union_9 = SolidUnion(Breps=[extrude_18, extrude_19, offset_surface_6])
merge_faces_9 = MergeFaces(Brep=solid_union_9)  # -> Breps, Before, After
deconstruct_brep_17 = DeconstructBrep(Brep=merge_faces_9.Breps)  # -> Faces, Edges, Vertices
evaluate_surface_18 = EvaluateSurface(Surface=reparameterize(deconstruct_brep_17.Faces), Point="0.5,0.5")  # -> Point, Normal, UDirection, VDirection, Frame
deconstruct_vector_12 = DeconstructVector(Vector=evaluate_surface_18.Normal)  # -> XComponent, YComponent, ZComponent
equality_19 = Equality(FirstNumber=deconstruct_vector_12.XComponent, SecondNumber=1)  # -> Equality, Inequality
equality_20 = Equality(FirstNumber=deconstruct_vector_12.XComponent, SecondNumber=-1)  # -> Equality, Inequality
number_10 = Number(number_9)
cull_pattern_25 = CullPattern(List=deconstruct_brep_17.Faces, CullPattern=equality_19.Equality)
cull_pattern_26 = CullPattern(List=deconstruct_brep_17.Faces, CullPattern=equality_20.Equality)
panel_57 = Panel(cull_pattern_25)

unit_x_2 = UnitX(Factor=number_10)

negative_12 = Negative(Value=unit_x_2)
extrude_20 = Extrude(Base=cull_pattern_25, Direction=unit_x_2)  # -> flatten(Extrusion)
extrude_21 = Extrude(Base=cull_pattern_26, Direction=negative_12)  # -> flatten(Extrusion)
panel_58 = Panel(extrude_20)
solid_union_10 = SolidUnion(Breps=[extrude_20, extrude_21, merge_faces_9.Breps])

# ---- group: Y
merge_faces_10 = MergeFaces(Brep=solid_union_10)  # -> Breps, Before, After

# ---- group: X
solid_difference_4 = SolidDifference(BrepsA=merge_faces_5.Breps, BrepsB=merge_faces_10.Breps)

# ----
solid_difference_5 = SolidDifference(BrepsA=brep, BrepsB=solid_difference_4)

# ---- group: Z
solid_difference_6 = SolidDifference(BrepsA=solid_difference_5, BrepsB=merge_faces_10.Breps)

# ----
x_sheets_2 = Brep(solid_difference_4)
y_sheets_2 = Brep(merge_faces_10.Breps)
z_sheets_2 = Brep(solid_difference_6)

# ---- group: Keep Separted Branches
stack_trees_5 = StackTrees(Data0=x_sheets_2, Data1=y_sheets_2, Data2=z_sheets_2, Reduce=True)

# ----
x_sheets_3 = Brep(x_sheets_2)
y_sheets_3 = Brep(y_sheets_2)
z_sheets_3 = Brep(z_sheets_2)
object_bake_3 = ObjectBake(
    BakeToggle=boolean_2,
    GeometryObjects=stack_trees_5,
    Layer=graft_tree_2,
    ObjectName="GH_Obj",
    ObjectColor=RGB(255, 255, 255),
    LayerColor=RGB(255, 255, 255))
custom_preview_materials_7 = CustomPreviewMaterials(Geometry=x_sheets_2, DiffuseColor=ColourSwatch(SwatchColor=RGB(129, 214, 186)))
custom_preview_materials_8 = CustomPreviewMaterials(Geometry=y_sheets_2, DiffuseColor=ColourSwatch(SwatchColor=RGB(167, 112, 230)))
custom_preview_materials_9 = CustomPreviewMaterials(Geometry=z_sheets_2, DiffuseColor=ColourSwatch(SwatchColor=RGB(244, 255, 94)))

# ---- group: Y Sheets Unrolled
y_brep_4 = Brep([<brep referenced from the Rhino model> x11])
panel_59 = Panel(y_brep_4)
deconstruct_brep_18 = DeconstructBrep(Brep=y_brep_4)  # -> Faces, Edges, Vertices
area_4 = Area(Geometry=deconstruct_brep_18.Faces)  # -> Area, Centroid
sort_list_4 = SortList(Keys=area_4.Area, ValuesValuesA=deconstruct_brep_18.Faces)  # -> Keys, ValuesValuesA
panel_60 = Panel(deconstruct_brep_18.Faces)
first_last_4 = FirstLast(List=sort_list_4.ValuesValuesA)  # -> FirstValue, LastValue
panel_61 = Panel(sort_list_4.Keys)
surface_5 = Surface(flatten(first_last_4.LastValue))
brep_edges_5 = BrepEdges(Brep=surface_5)  # -> Naked, Interior, NonManifold
join_curves_6 = JoinCurves(Curves=brep_edges_5.Naked, Preserve=False)  # -> flatten(Curves)
panel_62 = Panel(join_curves_6)
evaluate_surface_19 = EvaluateSurface(Surface=reparameterize(surface_5), Point="0.5,0.5")  # -> Point, Normal, UDirection, VDirection, Frame

# ---- group: Y Sheets Unrolled / Center 1
number_slider_11 = Slider(10, range=0..10)
list_item_9 = ListItem(List=join_curves_6, Index=number_slider_11, Wrap=True)
boundary_surfaces_5 = BoundarySurfaces(Edges=list_item_9)
evaluate_surface_20 = EvaluateSurface(Surface=reparameterize(boundary_surfaces_5), Point="0.5, 0.5")  # -> Point, Normal, UDirection, VDirection, Frame
plane_normal_9 = PlaneNormal(Origin=evaluate_surface_20.Point, ZAxis=evaluate_surface_20.Normal)  # -> flatten(Plane)
offset_curve_4 = OffsetCurve(Curve=flatten(list_item_9), Distance=Slider(-0.899, range=-1..1), Plane=plane_normal_9, Corners=1)
polygon_center_7 = PolygonCenter(Polyline=offset_curve_4)  # -> CenterV, CenterE, CenterA
point_7 = Point(polygon_center_7.CenterA)

# ---- group: Y Sheets Unrolled (continued)
cull_index_5 = CullIndex(List=join_curves_6, Indices=number_slider_11, Wrap=True)
polygon_center_8 = PolygonCenter(Polyline=cull_index_5)  # -> CenterV, CenterE, CenterA
point_8 = Point(polygon_center_8.CenterA)
merge_6 = Merge(Data1=point_8, Data2=point_7)
plane_normal_10 = PlaneNormal(Origin=merge_6, ZAxis=evaluate_surface_19.Normal)
align_planes_4 = AlignPlanes(Planes=plane_normal_10)
list_length_8 = ListLength(List=align_planes_4)
panel_63 = Panel(list_length_8)
series_4 = Series(Start=1, Step=1, Count=list_length_8)
concatenate_4 = Concatenate(FragmentA="Y-", FragmentB=series_4)
panel_64 = Panel(concatenate_4)
text_4 = Text(Location=align_planes_4, Text=concatenate_4, Size=Slider(0.2, range=0..10), Font=Slider(47, range=0..100))
unroll_polysurface_4 = UnrollPolysurface(Polysurface=graft(surface_5), Curves=text_4)  # -> flatten(Unrolled), UnrolledPoints, UnrolledCurves

# ----
panel_65 = Panel(point_8)
geometry = Geometry(unroll_polysurface_4.Unrolled)

# ---- group: X Sheets Unrolled
x_brep_4 = Brep([<brep referenced from the Rhino model> x11])
panel_66 = Panel(x_brep_4)
deconstruct_brep_19 = DeconstructBrep(Brep=x_brep_4)  # -> Faces, Edges, Vertices
area_5 = Area(Geometry=deconstruct_brep_19.Faces)  # -> Area, Centroid
sort_list_5 = SortList(Keys=area_5.Area, ValuesValuesA=deconstruct_brep_19.Faces)  # -> Keys, ValuesValuesA
panel_67 = Panel(deconstruct_brep_19.Faces)
first_last_5 = FirstLast(List=sort_list_5.ValuesValuesA)  # -> FirstValue, LastValue
surface_6 = Surface(flatten(first_last_5.LastValue))
panel_68 = Panel(surface_6)
brep_edges_6 = BrepEdges(Brep=surface_6)  # -> Naked, Interior, NonManifold
join_curves_7 = JoinCurves(Curves=brep_edges_6.Naked, Preserve=False)  # -> flatten(Curves)
number_slider_12 = Slider(0.2, range=0..10)
number_slider_13 = Slider(47, range=0..100)

# ----
clean_tree = CleanTree(RemoveNulls=boolean_toggle, RemoveInvalid=boolean_toggle, RemoveEmpty=False, Tree=surface_6)
clean_tree_2 = CleanTree(RemoveNulls=boolean_toggle_2, RemoveInvalid=boolean_toggle_2, RemoveEmpty=boolean_toggle_2, Tree=join_curves_7)

# ---- group: Center 1
list_item_10 = ListItem(List=clean_tree_2, Index=Slider(9, range=0..10), Wrap=True)
boundary_surfaces_6 = BoundarySurfaces(Edges=list_item_10)
evaluate_surface_21 = EvaluateSurface(Surface=reparameterize(boundary_surfaces_6), Point="0.5, 0.5")  # -> Point, Normal, UDirection, VDirection, Frame
plane_normal_11 = PlaneNormal(Origin=evaluate_surface_21.Point, ZAxis=evaluate_surface_21.Normal)  # -> flatten(Plane)
offset_curve_5 = OffsetCurve(Curve=flatten(list_item_10), Distance=Slider(-0.899, range=-1..1), Plane=plane_normal_11, Corners=1)
polygon_center_9 = PolygonCenter(Polyline=offset_curve_5)  # -> CenterV, CenterE, CenterA
point_9 = Point(polygon_center_9.CenterA)

# ---- group: X Sheets Unrolled
list_item_11 = ListItem(List=clean_tree_2, Index=Slider(5, range=0..10), Wrap=True)
list_item_12 = ListItem(List=clean_tree_2, Index=Slider(4, range=0..10), Wrap=True)
list_item_13 = ListItem(List=clean_tree_2, Index=Slider(7, range=0..10), Wrap=True)
list_item_14 = ListItem(List=clean_tree_2, Index=Slider(3, range=0..10), Wrap=True)
point_10 = Point(<point referenced from the Rhino model>)
point_11 = Point(<point referenced from the Rhino model>)
point_12 = Point(<point referenced from the Rhino model>)
point_13 = Point(<point referenced from the Rhino model>)

# ----
cull_index_6 = CullIndex(List=clean_tree_2, Indices=panel_15, Wrap=True)
polygon_center_10 = PolygonCenter(Polyline=cull_index_6)  # -> CenterV, CenterE, CenterA
point_14 = Point(polygon_center_10.CenterA)
merge_7 = Merge(Data1=point_14, Data2=point_9, Data3=point_13, Data4=point_10, Data5=point_12, Data6=point_11)  # -> flatten(Result)
list_length_9 = ListLength(List=merge_7)
panel_69 = Panel(list_length_9)

# ---- group: Z Sheets Unrolled
z_brep_4 = Brep([<brep referenced from the Rhino model> x15])
panel_70 = Panel(z_brep_4)
deconstruct_brep_20 = DeconstructBrep(Brep=z_brep_4)  # -> Faces, Edges, Vertices
area_6 = Area(Geometry=deconstruct_brep_20.Faces)  # -> Area, Centroid
sort_list_6 = SortList(Keys=area_6.Area, ValuesValuesA=deconstruct_brep_20.Faces)  # -> Keys, ValuesValuesA
panel_71 = Panel(deconstruct_brep_20.Faces)
panel_72 = Panel(sort_list_6.Keys)
first_last_6 = FirstLast(List=sort_list_6.ValuesValuesA)  # -> FirstValue, LastValue
surface_7 = Surface(flatten(first_last_6.LastValue))
brep_edges_7 = BrepEdges(Brep=surface_7)  # -> Naked, Interior, NonManifold
join_curves_8 = JoinCurves(Curves=brep_edges_7.Naked, Preserve=False)  # -> flatten(Curves)
evaluate_surface_22 = EvaluateSurface(Surface=reparameterize(surface_7), Point="0.5,0.5")  # -> Point, Normal, UDirection, VDirection, Frame
panel_73 = Panel(join_curves_8)

# ---- group: Z Sheets Unrolled / Center 1
number_slider_14 = Slider(10, range=0..10)
list_item_15 = ListItem(List=join_curves_8, Index=number_slider_14, Wrap=True)
boundary_surfaces_7 = BoundarySurfaces(Edges=list_item_15)
evaluate_surface_23 = EvaluateSurface(Surface=reparameterize(boundary_surfaces_7), Point="0.5, 0.5")  # -> Point, Normal, UDirection, VDirection, Frame
plane_normal_12 = PlaneNormal(Origin=evaluate_surface_23.Point, ZAxis=evaluate_surface_23.Normal)  # -> flatten(Plane)
offset_curve_6 = OffsetCurve(Curve=flatten(list_item_15), Distance=Slider(-0.899, range=-1..1), Plane=plane_normal_12, Corners=1)
polygon_center_11 = PolygonCenter(Polyline=offset_curve_6)  # -> CenterV, CenterE, CenterA
point_15 = Point(polygon_center_11.CenterA)

# ---- group: Z Sheets Unrolled (continued)
cull_index_7 = CullIndex(List=join_curves_8, Indices=number_slider_14, Wrap=True)
polygon_center_12 = PolygonCenter(Polyline=cull_index_7)  # -> CenterV, CenterE, CenterA
point_16 = Point(polygon_center_12.CenterA)
merge_8 = Merge(Data1=point_16, Data2=point_15)
plane_normal_13 = PlaneNormal(Origin=merge_8, ZAxis=evaluate_surface_22.Normal)
align_planes_5 = AlignPlanes(Planes=plane_normal_13)
list_length_10 = ListLength(List=align_planes_5)
panel_74 = Panel(list_length_10)
series_5 = Series(Start=1, Step=1, Count=list_length_10)
concatenate_5 = Concatenate(FragmentA="Z-", FragmentB=series_5)
panel_75 = Panel(concatenate_5)
text_5 = Text(Location=align_planes_5, Text=concatenate_5, Size=Slider(0.2, range=0..10), Font=Slider(47, range=0..100))
unroll_polysurface_5 = UnrollPolysurface(Polysurface=graft(surface_7), Curves=text_5)  # -> flatten(Unrolled), UnrolledPoints, UnrolledCurves

# ---- group: X Sheets Unrolled (continued)
evaluate_surface_24 = EvaluateSurface(Surface=reparameterize(clean_tree), Point="0.5,0.5")  # -> Point, Normal, UDirection, VDirection, Frame
panel_76 = Panel(clean_tree_2)
plane_normal_14 = PlaneNormal(Origin=merge_7, ZAxis=evaluate_surface_24.Normal)
align_planes_6 = AlignPlanes(Planes=plane_normal_14)
list_length_11 = ListLength(List=align_planes_6)
series_6 = Series(Start=1, Step=1, Count=list_length_11)
concatenate_6 = Concatenate(FragmentA="X-", FragmentB=series_6)
panel_77 = Panel(concatenate_6)

# ----
text_6 = Text(Location=align_planes_6, Text=concatenate_6, Size=number_slider_12, Font=number_slider_13)

# ---- group: X Sheets Unrolled (continued)
unroll_polysurface_6 = UnrollPolysurface(Polysurface=graft(clean_tree), Curves=text_6)  # -> flatten(Unrolled), UnrolledPoints, UnrolledCurves

# ----
geometry_2 = Geometry(unroll_polysurface_6.Unrolled)
merge_9 = Merge(Data1=unroll_polysurface_6.Unrolled, Data2=unroll_polysurface_4.Unrolled, Data3=unroll_polysurface_5.Unrolled)
stack_trees_6 = StackTrees(
    Data0=unroll_polysurface_6.UnrolledCurves,
    Data1=unroll_polysurface_4.UnrolledCurves,
    Data2=unroll_polysurface_5.UnrolledCurves,
    Reduce=True)
stack_trees_7 = StackTrees(Data0=text_6, Data1=text_4, Data2=text_5, Reduce=True)
nested_surface_3 = Surface(merge_9)
nested_text_curve_3 = Curve(stack_trees_6)
_3d_text_curve_3 = Curve(stack_trees_7)

# ==== cluster Cluster
void_model = ClusterInput()
thickness_2 = ClusterInput()
boolean = ClusterInput()
panel = Panel("""X Face
Y Face
Z Face""")
boolean_2 = Boolean(boolean)
graft_tree = GraftTree(Tree=panel, IncludeEmptyLists=True, IncludeNullItems=True)

# ---- group: Thicken Sheets
void_model_2 = Brep(void_model)
deconstruct_brep = DeconstructBrep(Brep=void_model_2)  # -> Faces, Edges, Vertices
evaluate_surface = EvaluateSurface(Surface=reparameterize(deconstruct_brep.Faces), Point="0.5,0.5")  # -> Point, Normal, UDirection, VDirection, Frame
plane_normal = PlaneNormal(Origin=evaluate_surface.Point, ZAxis=evaluate_surface.Normal)
deconstruct_plane = DeconstructPlane(Plane=plane_normal)  # -> Origin, XAxis, YAxis, ZAxisTheNormalFacePerpendicularToTheOriginPlan
deconstruct_vector = DeconstructVector(Vector=deconstruct_plane.ZAxisTheNormalFacePerpendicularToTheOriginPlan)  # -> XComponent, YComponent, ZComponent
panel_2 = Panel(deconstruct_vector.ZComponent)
round = Round(Number=deconstruct_vector.XComponent)  # -> Nearest, Floor, Ceiling
round_2 = Round(Number=deconstruct_vector.YComponent)  # -> Nearest, Floor, Ceiling
round_3 = Round(Number=deconstruct_vector.ZComponent)  # -> Nearest, Floor, Ceiling
number_slider = Slider(0.03, range=0..1)
thickness_2_2 = Number(thickness_2)
negative = Negative(Value=thickness_2_2)

# ---- group: Thicken Sheets / Get rid of any negative value
absolute = Absolute(Value=round.Nearest)
absolute_2 = Absolute(Value=round_3.Nearest)
absolute_3 = Absolute(Value=round_2.Nearest)

# ---- group: Thicken Sheets (continued)
panel_3 = Panel(absolute)
larger_than = LargerThan(FirstNumber=absolute, SecondNumber=0)  # -> LargerThan, OrEqualTo
larger_than_2 = LargerThan(FirstNumber=absolute_2, SecondNumber=0)  # -> LargerThan, OrEqualTo
larger_than_3 = LargerThan(FirstNumber=absolute_3, SecondNumber=0)  # -> LargerThan, OrEqualTo
panel_4 = Panel(larger_than.LargerThan)
cull_pattern = CullPattern(List=deconstruct_brep.Faces, CullPattern=larger_than.LargerThan)
cull_pattern_2 = CullPattern(List=deconstruct_brep.Faces, CullPattern=larger_than_3.LargerThan)
cull_pattern_3 = CullPattern(List=deconstruct_brep.Faces, CullPattern=larger_than_2.LargerThan)
offset_surface = OffsetSurface(Surface=cull_pattern, Distance=negative, BothSides=thickness_2_2, CreateSolid=True)  # -> flatten(Offset)
offset_surface_2 = OffsetSurface(Surface=cull_pattern_3, Distance=negative, BothSides=thickness_2_2, CreateSolid=True)  # -> flatten(Offset)
offset_surface_3 = OffsetSurface(Surface=cull_pattern_2, Distance=negative, BothSides=thickness_2_2, CreateSolid=True)  # -> flatten(Offset)

# ----
deconstruct_brep_2 = DeconstructBrep(Brep=offset_surface)  # -> Faces, Edges, Vertices
evaluate_surface_2 = EvaluateSurface(Surface=reparameterize(deconstruct_brep_2.Faces), Point="0.5,0.5")  # -> Point, Normal, UDirection, VDirection, Frame
deconstruct_vector_2 = DeconstructVector(Vector=evaluate_surface_2.Normal)  # -> XComponent, YComponent, ZComponent
equality = Equality(FirstNumber=deconstruct_vector_2.ZComponent, SecondNumber=1)  # -> Equality, Inequality
equality_2 = Equality(FirstNumber=deconstruct_vector_2.ZComponent, SecondNumber=-1)  # -> Equality, Inequality
number = Number(thickness_2_2)
cull_pattern_4 = CullPattern(List=deconstruct_brep_2.Faces, CullPattern=equality.Equality)
cull_pattern_5 = CullPattern(List=deconstruct_brep_2.Faces, CullPattern=equality_2.Equality)
unit_z = UnitZ(Factor=number)
panel_5 = Panel(cull_pattern_4)
negative_2 = Negative(Value=unit_z)
extrude = Extrude(Base=cull_pattern_4, Direction=unit_z)  # -> flatten(Extrusion)
extrude_2 = Extrude(Base=cull_pattern_5, Direction=negative_2)  # -> flatten(Extrusion)
panel_6 = Panel(extrude)
solid_union = SolidUnion(Breps=[extrude, extrude_2, offset_surface])
merge_faces = MergeFaces(Brep=solid_union)  # -> Breps, Before, After
deconstruct_brep_3 = DeconstructBrep(Brep=merge_faces.Breps)  # -> Faces, Edges, Vertices
evaluate_surface_3 = EvaluateSurface(Surface=reparameterize(deconstruct_brep_3.Faces), Point="0.5,0.5")  # -> Point, Normal, UDirection, VDirection, Frame
deconstruct_vector_3 = DeconstructVector(Vector=evaluate_surface_3.Normal)  # -> XComponent, YComponent, ZComponent
equality_3 = Equality(FirstNumber=deconstruct_vector_3.YComponent, SecondNumber=1)  # -> Equality, Inequality
equality_4 = Equality(FirstNumber=deconstruct_vector_3.YComponent, SecondNumber=-1)  # -> Equality, Inequality
number_2 = Number(number)
cull_pattern_6 = CullPattern(List=deconstruct_brep_3.Faces, CullPattern=equality_3.Equality)
cull_pattern_7 = CullPattern(List=deconstruct_brep_3.Faces, CullPattern=equality_4.Equality)
unit_y = UnitY(Factor=number_2)
panel_7 = Panel(cull_pattern_6)
negative_3 = Negative(Value=unit_y)
extrude_3 = Extrude(Base=cull_pattern_6, Direction=unit_y)  # -> flatten(Extrusion)
extrude_4 = Extrude(Base=cull_pattern_7, Direction=negative_3)  # -> flatten(Extrusion)
panel_8 = Panel(extrude_3)
solid_union_2 = SolidUnion(Breps=[extrude_3, extrude_4, merge_faces.Breps])
merge_faces_2 = MergeFaces(Brep=solid_union_2)  # -> Breps, Before, After

deconstruct_brep_4 = DeconstructBrep(Brep=offset_surface_2)  # -> Faces, Edges, Vertices
evaluate_surface_4 = EvaluateSurface(Surface=reparameterize(deconstruct_brep_4.Faces), Point="0.5,0.5")  # -> Point, Normal, UDirection, VDirection, Frame
deconstruct_vector_4 = DeconstructVector(Vector=evaluate_surface_4.Normal)  # -> XComponent, YComponent, ZComponent
equality_5 = Equality(FirstNumber=deconstruct_vector_4.YComponent, SecondNumber=1)  # -> Equality, Inequality
equality_6 = Equality(FirstNumber=deconstruct_vector_4.YComponent, SecondNumber=-1)  # -> Equality, Inequality
number_3 = Number(thickness_2_2)
cull_pattern_8 = CullPattern(List=deconstruct_brep_4.Faces, CullPattern=equality_5.Equality)
cull_pattern_9 = CullPattern(List=deconstruct_brep_4.Faces, CullPattern=equality_6.Equality)
unit_y_2 = UnitY(Factor=number_3)
panel_9 = Panel(cull_pattern_8)
negative_4 = Negative(Value=unit_y_2)
extrude_5 = Extrude(Base=cull_pattern_8, Direction=unit_y_2)  # -> flatten(Extrusion)
extrude_6 = Extrude(Base=cull_pattern_9, Direction=negative_4)  # -> flatten(Extrusion)
solid_union_3 = SolidUnion(Breps=[extrude_5, extrude_6, offset_surface_2])
merge_faces_3 = MergeFaces(Brep=solid_union_3)  # -> Breps, Before, After

brep = Brep(merge_faces_3.Breps)

deconstruct_brep_5 = DeconstructBrep(Brep=offset_surface_3)  # -> Faces, Edges, Vertices
evaluate_surface_5 = EvaluateSurface(Surface=reparameterize(deconstruct_brep_5.Faces), Point="0.5,0.5")  # -> Point, Normal, UDirection, VDirection, Frame
deconstruct_vector_5 = DeconstructVector(Vector=evaluate_surface_5.Normal)  # -> XComponent, YComponent, ZComponent
equality_7 = Equality(FirstNumber=deconstruct_vector_5.ZComponent, SecondNumber=1)  # -> Equality, Inequality
equality_8 = Equality(FirstNumber=deconstruct_vector_5.ZComponent, SecondNumber=-1)  # -> Equality, Inequality
number_4 = Number(thickness_2_2)
cull_pattern_10 = CullPattern(List=deconstruct_brep_5.Faces, CullPattern=equality_7.Equality)
cull_pattern_11 = CullPattern(List=deconstruct_brep_5.Faces, CullPattern=equality_8.Equality)
unit_z_2 = UnitZ(Factor=number_4)
panel_10 = Panel(cull_pattern_10)
negative_5 = Negative(Value=unit_z_2)
extrude_7 = Extrude(Base=cull_pattern_10, Direction=unit_z_2)  # -> flatten(Extrusion)
extrude_8 = Extrude(Base=cull_pattern_11, Direction=negative_5)  # -> flatten(Extrusion)
panel_11 = Panel(extrude_7)
solid_union_4 = SolidUnion(Breps=[extrude_7, extrude_8, offset_surface_3])
merge_faces_4 = MergeFaces(Brep=solid_union_4)  # -> Breps, Before, After
deconstruct_brep_6 = DeconstructBrep(Brep=merge_faces_4.Breps)  # -> Faces, Edges, Vertices
evaluate_surface_6 = EvaluateSurface(Surface=reparameterize(deconstruct_brep_6.Faces), Point="0.5,0.5")  # -> Point, Normal, UDirection, VDirection, Frame
deconstruct_vector_6 = DeconstructVector(Vector=evaluate_surface_6.Normal)  # -> XComponent, YComponent, ZComponent
equality_9 = Equality(FirstNumber=deconstruct_vector_6.XComponent, SecondNumber=1)  # -> Equality, Inequality
equality_10 = Equality(FirstNumber=deconstruct_vector_6.XComponent, SecondNumber=-1)  # -> Equality, Inequality
number_5 = Number(number_4)
cull_pattern_12 = CullPattern(List=deconstruct_brep_6.Faces, CullPattern=equality_9.Equality)
cull_pattern_13 = CullPattern(List=deconstruct_brep_6.Faces, CullPattern=equality_10.Equality)
panel_12 = Panel(cull_pattern_12)

unit_x = UnitX(Factor=number_5)

negative_6 = Negative(Value=unit_x)
extrude_9 = Extrude(Base=cull_pattern_12, Direction=unit_x)  # -> flatten(Extrusion)
extrude_10 = Extrude(Base=cull_pattern_13, Direction=negative_6)  # -> flatten(Extrusion)
panel_13 = Panel(extrude_9)
solid_union_5 = SolidUnion(Breps=[extrude_9, extrude_10, merge_faces_4.Breps])

# ---- group: Y
merge_faces_5 = MergeFaces(Brep=solid_union_5)  # -> Breps, Before, After

# ---- group: X
solid_difference = SolidDifference(BrepsA=merge_faces_2.Breps, BrepsB=merge_faces_5.Breps)

# ----
solid_difference_2 = SolidDifference(BrepsA=brep, BrepsB=solid_difference)

# ---- group: Z
solid_difference_3 = SolidDifference(BrepsA=solid_difference_2, BrepsB=merge_faces_5.Breps)

# ----
x_sheets = Brep(solid_difference)
y_sheets = Brep(merge_faces_5.Breps)
z_sheets = Brep(solid_difference_3)

# ---- group: Keep Separted Branches
stack_trees = StackTrees(Data0=x_sheets, Data1=y_sheets, Data2=z_sheets, Reduce=True)

# ----
x_sheets_2 = ClusterOutput(x_sheets)
y_sheets_2 = ClusterOutput(y_sheets)
z_sheets_2 = ClusterOutput(z_sheets)
object_bake = ObjectBake(
    BakeToggle=boolean_2,
    GeometryObjects=stack_trees,
    Layer=graft_tree,
    ObjectName="GH_Obj",
    ObjectColor=RGB(255, 255, 255),
    LayerColor=RGB(255, 255, 255))
custom_preview_materials = CustomPreviewMaterials(Geometry=x_sheets, DiffuseColor=ColourSwatch(SwatchColor=RGB(129, 214, 186)))
custom_preview_materials_2 = CustomPreviewMaterials(Geometry=y_sheets, DiffuseColor=ColourSwatch(SwatchColor=RGB(167, 112, 230)))
custom_preview_materials_3 = CustomPreviewMaterials(Geometry=z_sheets, DiffuseColor=ColourSwatch(SwatchColor=RGB(244, 255, 94)))

# ==== cluster Cluster_2
y_brep = ClusterInput()
font_size = ClusterInput()
font_size_2 = ClusterInput()
y_brep_2 = Brep(y_brep)
z_brep = ClusterInput()
font_size_3 = Number(font_size)
font_size_4 = Integer(font_size_2)
panel = Panel(y_brep_2)
deconstruct_brep = DeconstructBrep(Brep=y_brep_2)  # -> Faces, Edges, Vertices
area = Area(Geometry=deconstruct_brep.Faces)  # -> Area, Centroid
sort_list = SortList(Keys=area.Area, ValuesValuesA=deconstruct_brep.Faces)  # -> Keys, ValuesValuesA
panel_2 = Panel(deconstruct_brep.Faces)
first_last = FirstLast(List=sort_list.ValuesValuesA)  # -> FirstValue, LastValue
panel_3 = Panel(sort_list.Keys)
surface = Surface(flatten(first_last.LastValue))
x_brep = ClusterInput()
brep_edges = BrepEdges(Brep=surface)  # -> Naked, Interior, NonManifold

number_slider = Slider(10, range=0..10)
panel_4 = Panel(surface)
join_curves = JoinCurves(Curves=brep_edges.Naked, Preserve=False)  # -> flatten(Curves)
member_index = MemberIndex(Set=panel_4, Member="Untrimmed Surface")  # -> Index, Count
list_item = ListItem(List=surface, Index=member_index.Index, Wrap=True)
deconstruct_brep_2 = DeconstructBrep(Brep=list_item)  # -> Faces, Edges, Vertices
join_curves_2 = JoinCurves(Curves=deconstruct_brep_2.Edges, Preserve=False)  # -> flatten(Curves)
merge = Merge(Data1=join_curves_2, Data2=join_curves)
list_item_2 = ListItem(List=merge, Index=number_slider, Wrap=True)
boundary_surfaces = BoundarySurfaces(Edges=list_item_2)
evaluate_surface = EvaluateSurface(Surface=reparameterize(boundary_surfaces), Point="0.5, 0.5")  # -> Point, Normal, UDirection, VDirection, Frame
plane_normal = PlaneNormal(Origin=evaluate_surface.Point, ZAxis=evaluate_surface.Normal)  # -> flatten(Plane)
offset_curve = OffsetCurve(Curve=flatten(list_item_2), Distance=Slider(-0.899, range=-1..1), Plane=plane_normal, Corners=1)
cull_index = CullIndex(List=merge, Indices=number_slider, Wrap=True)
boundary_surfaces_2 = BoundarySurfaces(Edges=join_curves_2)
polygon_center = PolygonCenter(Polyline=offset_curve)  # -> CenterV, CenterE, CenterA
panel_5 = Panel(boundary_surfaces_2)
polygon_center_2 = PolygonCenter(Polyline=cull_index)  # -> CenterV, CenterE, CenterA
point = Point(polygon_center.CenterA)
point_2 = Point(polygon_center_2.CenterA)
merge_2 = Merge(Data1=point_2, Data2=point)
panel_6 = Panel(merge_2)

simplify_curve = SimplifyCurve(Curve=brep_edges.Naked)  # -> Curve, Simplified
join_curves_3 = JoinCurves(Curves=simplify_curve.Curve, Preserve=False)
evaluate_surface_2 = EvaluateSurface(Surface=reparameterize(surface), Point="0.5,0.5")  # -> Point, Normal, UDirection, VDirection, Frame
polygon_center_3 = PolygonCenter(Polyline=join_curves_3)  # -> CenterV, CenterE, CenterA
panel_7 = Panel(evaluate_surface_2.Point)

list_item_3 = ListItem(Index=Slider(5, range=0..10), Wrap=True)
list_item_4 = ListItem(Index=Slider(4, range=0..10), Wrap=True)
list_item_5 = ListItem(Index=Slider(7, range=0..10), Wrap=True)
list_item_6 = ListItem(Index=Slider(3, range=0..10), Wrap=True)
point_3 = Point(<point referenced from the Rhino model>)
point_4 = Point(<point referenced from the Rhino model>)
point_5 = Point(<point referenced from the Rhino model>)
point_6 = Point(<point referenced from the Rhino model>)

point_7 = Point(flatten(polygon_center_3.CenterA))
panel_8 = Panel(point_7)
plane_normal_2 = PlaneNormal(Origin=point_7, ZAxis=evaluate_surface_2.Normal)
align_planes = AlignPlanes(Planes=plane_normal_2)
list_length = ListLength(List=align_planes)
panel_9 = Panel(list_length)
series = Series(Start=1, Step=1, Count=list_length)
concatenate = Concatenate(FragmentA="Y-", FragmentB=series)
number_slider_2 = Slider(0.2, range=0..10)
font_table = FontTable()
number_slider_3 = Slider(47, range=0..100)
list_item_7 = ListItem(List=font_table, Index=font_size_4, Wrap=True)
panel_10 = Panel(concatenate)
font_table_2 = FontTable()
text = Text(Location=align_planes, Text=concatenate, Size=font_size_3, Font=list_item_7)
list_item_8 = ListItem(List=font_table_2, Index=font_size_4, Wrap=True)
unroll_polysurface = UnrollPolysurface(Polysurface=graft(surface), Curves=text)  # -> flatten(Unrolled), UnrolledPoints, UnrolledCurves
list_length_2 = ListLength(List=unroll_polysurface.UnrolledCurves)
geometry = Geometry(unroll_polysurface.Unrolled)
panel_11 = Panel(list_length_2)

x_brep_2 = Brep([<brep referenced from the Rhino model> x11])
deconstruct_brep_3 = DeconstructBrep(Brep=x_brep_2)  # -> Faces, Edges, Vertices
panel_12 = Panel(x_brep_2)
area_2 = Area(Geometry=deconstruct_brep_3.Faces)  # -> Area, Centroid
sort_list_2 = SortList(Keys=area_2.Area, ValuesValuesA=deconstruct_brep_3.Faces)  # -> Keys, ValuesValuesA
first_last_2 = FirstLast(List=sort_list_2.ValuesValuesA)  # -> FirstValue, LastValue
panel_13 = Panel(deconstruct_brep_3.Faces)
boolean_toggle = BooleanToggle(True)
surface_2 = Surface(flatten(first_last_2.LastValue))
list_item_9 = ListItem(List=surface_2, Index=Slider(8, range=0..10), Wrap=True)
panel_14 = Panel(surface_2)
clean_tree = CleanTree(RemoveNulls=boolean_toggle, RemoveInvalid=boolean_toggle, RemoveEmpty=False, Tree=surface_2)
brep_edges_2 = BrepEdges(Brep=surface_2)  # -> Naked, Interior, NonManifold
join_curves_4 = JoinCurves(Curves=brep_edges_2.Naked, Preserve=False)  # -> flatten(Curves)
boolean_toggle_2 = BooleanToggle(True)
clean_tree_2 = CleanTree(RemoveNulls=boolean_toggle_2, RemoveInvalid=boolean_toggle_2, RemoveEmpty=boolean_toggle_2, Tree=join_curves_4)
evaluate_surface_3 = EvaluateSurface(Surface=reparameterize(clean_tree), Point="0.5,0.5")  # -> Point, Normal, UDirection, VDirection, Frame
panel_15 = Panel("""3
4
5
7
9""")
cull_index_2 = CullIndex(List=clean_tree_2, Indices=panel_15, Wrap=True)
polygon_center_4 = PolygonCenter(Polyline=clean_tree_2)  # -> CenterV, CenterE, CenterA
panel_16 = Panel(join_curves_4)
point_8 = Point(polygon_center_4.CenterA)
number_slider_4 = Slider(47, range=0..100)
number_slider_5 = Slider(0.2, range=0..10)
font_table_3 = FontTable()
list_item_10 = ListItem(List=font_table_3, Index=0, Wrap=True)

# ---- group: Center 1
list_item_11 = ListItem(List=clean_tree_2, Index=Slider(9, range=0..10), Wrap=True)
boundary_surfaces_3 = BoundarySurfaces(Edges=list_item_11)
evaluate_surface_4 = EvaluateSurface(Surface=reparameterize(boundary_surfaces_3), Point="0.5, 0.5")  # -> Point, Normal, UDirection, VDirection, Frame
plane_normal_3 = PlaneNormal(Origin=evaluate_surface_4.Point, ZAxis=evaluate_surface_4.Normal)  # -> flatten(Plane)
offset_curve_2 = OffsetCurve(Curve=flatten(list_item_11), Distance=Slider(-0.899, range=-1..1), Plane=plane_normal_3, Corners=1)
polygon_center_5 = PolygonCenter(Polyline=offset_curve_2)  # -> CenterV, CenterE, CenterA
point_9 = Point(polygon_center_5.CenterA)

# ----
merge_3 = Merge(Data1=point_8, Data2=point_9)  # -> flatten(Result)
list_length_3 = ListLength(List=merge_3)
plane_normal_4 = PlaneNormal(Origin=merge_3, ZAxis=evaluate_surface_3.Normal)
panel_17 = Panel(list_length_3)
align_planes_2 = AlignPlanes(Planes=plane_normal_4)
list_length_4 = ListLength(List=align_planes_2)
series_2 = Series(Start=1, Step=1, Count=list_length_4)
concatenate_2 = Concatenate(FragmentA="X-", FragmentB=series_2)
panel_18 = Panel(concatenate_2)
text_2 = Text(Location=align_planes_2, Text=concatenate_2, Size=1)
unroll_polysurface_2 = UnrollPolysurface(Polysurface=graft(clean_tree), Curves=text_2)  # -> flatten(Unrolled), UnrolledPoints, UnrolledCurves
offset_curve_3 = OffsetCurve(Curve=text_2, Distance=Slider(0, range=0..1), Corners=1)  # -> flatten(Curve)
boundary_surfaces_4 = BoundarySurfaces(Edges=offset_curve_3)
geometry_2 = Geometry(unroll_polysurface_2.Unrolled)
brep_edges_3 = BrepEdges(Brep=boundary_surfaces_4)  # -> Naked, Interior, NonManifold
panel_19 = Panel(offset_curve_3)
join_curves_5 = JoinCurves(Curves=brep_edges_3.Naked, Preserve=False)

# ---- group: Z Sheets Unrolled
z_brep_2 = Brep(z_brep)
panel_20 = Panel(z_brep_2)
deconstruct_brep_4 = DeconstructBrep(Brep=z_brep_2)  # -> Faces, Edges, Vertices
area_3 = Area(Geometry=deconstruct_brep_4.Faces)  # -> Area, Centroid
sort_list_3 = SortList(Keys=area_3.Area, ValuesValuesA=deconstruct_brep_4.Faces)  # -> Keys, ValuesValuesA
panel_21 = Panel(deconstruct_brep_4.Faces)
first_last_3 = FirstLast(List=sort_list_3.ValuesValuesA)  # -> FirstValue, LastValue
surface_3 = Surface(flatten(first_last_3.LastValue))
panel_22 = Panel(surface_3)
brep_edges_4 = BrepEdges(Brep=surface_3)  # -> Naked, Interior, NonManifold
join_curves_6 = JoinCurves(Curves=brep_edges_4.Naked, Preserve=False)  # -> flatten(Curves)
evaluate_surface_5 = EvaluateSurface(Surface=reparameterize(surface_3), Point="0.5,0.5")  # -> Point, Normal, UDirection, VDirection, Frame
panel_23 = Panel(join_curves_6)
number_slider_6 = Slider(0.2, range=0..10)

# ---- group: Z Sheets Unrolled / Center 1
number_slider_7 = Slider(10, range=0..10)
list_item_12 = ListItem(List=join_curves_6, Index=number_slider_7, Wrap=True)
boundary_surfaces_5 = BoundarySurfaces(Edges=list_item_12)
evaluate_surface_6 = EvaluateSurface(Surface=reparameterize(boundary_surfaces_5), Point="0.5, 0.5")  # -> Point, Normal, UDirection, VDirection, Frame
plane_normal_5 = PlaneNormal(Origin=evaluate_surface_6.Point, ZAxis=evaluate_surface_6.Normal)  # -> flatten(Plane)
offset_curve_4 = OffsetCurve(Curve=flatten(list_item_12), Distance=Slider(-0.899, range=-1..1), Plane=plane_normal_5, Corners=1)
polygon_center_6 = PolygonCenter(Polyline=offset_curve_4)  # -> CenterV, CenterE, CenterA
point_10 = Point(polygon_center_6.CenterA)

# ---- group: Z Sheets Unrolled (continued)
cull_index_3 = CullIndex(List=join_curves_6, Indices=number_slider_7, Wrap=True)
polygon_center_7 = PolygonCenter(Polyline=cull_index_3)  # -> CenterV, CenterE, CenterA
point_11 = Point(polygon_center_7.CenterA)
merge_4 = Merge(Data1=point_11, Data2=point_10)
plane_normal_6 = PlaneNormal(Origin=merge_4, ZAxis=evaluate_surface_5.Normal)
align_planes_3 = AlignPlanes(Planes=plane_normal_6)
list_length_5 = ListLength(List=align_planes_3)
panel_24 = Panel(list_length_5)
series_3 = Series(Start=1, Step=1, Count=list_length_5)
concatenate_3 = Concatenate(FragmentA="Z-", FragmentB=series_3)
panel_25 = Panel(concatenate_3)
text_3 = Text(Location=align_planes_3, Text=concatenate_3, Size=font_size_3, Font=list_item_8)
unroll_polysurface_3 = UnrollPolysurface(Polysurface=graft(surface_3), Curves=text_3)  # -> flatten(Unrolled), UnrolledPoints, UnrolledCurves

# ----
panel_26 = Panel(merge_4)
text_4 = Text(Location=align_planes_3, Text=concatenate_3, Size=font_size_3, Font=list_item_8)  # -> flatten(Curves)
unroll_polysurface_4 = UnrollPolysurface(Polysurface=graft(surface_3), Curves=text_4)  # -> flatten(Unrolled), UnrolledPoints, UnrolledCurves
geometry_3 = Geometry(unroll_polysurface_3.Unrolled)

x_brep_3 = Brep(x_brep)
deconstruct_brep_5 = DeconstructBrep(Brep=x_brep_3)  # -> Faces, Edges, Vertices
panel_27 = Panel(deconstruct_brep_5.Faces)
area_4 = Area(Geometry=deconstruct_brep_5.Faces)  # -> Area, Centroid
sort_list_4 = SortList(Keys=area_4.Area, ValuesValuesA=deconstruct_brep_5.Faces)  # -> Keys, ValuesValuesA
first_last_4 = FirstLast(List=sort_list_4.ValuesValuesA)  # -> FirstValue, LastValue
surface_4 = Surface(flatten(first_last_4.LastValue))
brep_edges_5 = BrepEdges(Brep=surface_4)  # -> Naked, Interior, NonManifold
panel_28 = Panel(surface_4)
evaluate_surface_7 = EvaluateSurface(Surface=reparameterize(surface_4), Point="0.5,0.5")  # -> Point, Normal, UDirection, VDirection, Frame
join_curves_7 = JoinCurves(Curves=brep_edges_5.Naked, Preserve=False)  # -> flatten(Curves)
number_slider_8 = Slider(47, range=0..100)
number_slider_9 = Slider(0.2, range=0..10)
font_table_4 = FontTable()
list_item_13 = ListItem(List=font_table_4, Index=font_size_4, Wrap=True)

# ---- group: Center 1
number_slider_10 = Slider(9, range=0..10)
list_item_14 = ListItem(List=surface_4, Index=number_slider_10, Wrap=True)
boundary_surfaces_6 = BoundarySurfaces(Edges=list_item_14)
evaluate_surface_8 = EvaluateSurface(Surface=reparameterize(boundary_surfaces_6), Point="0.5, 0.5")  # -> Point, Normal, UDirection, VDirection, Frame
plane_normal_7 = PlaneNormal(Origin=evaluate_surface_8.Point, ZAxis=evaluate_surface_8.Normal)  # -> flatten(Plane)
offset_curve_5 = OffsetCurve(Curve=flatten(list_item_14), Distance=Slider(-0.899, range=-1..1), Plane=plane_normal_7, Corners=1)
polygon_center_8 = PolygonCenter(Polyline=offset_curve_5)  # -> CenterV, CenterE, CenterA
point_12 = Point(polygon_center_8.CenterA)

# ----
cull_index_4 = CullIndex(List=join_curves_7, Indices=number_slider_10, Wrap=True)
polygon_center_9 = PolygonCenter(Polyline=cull_index_4)  # -> CenterV, CenterE, CenterA
point_13 = Point(polygon_center_9.CenterA)
merge_5 = Merge(Data1=point_13, Data2=point_12)  # -> flatten(Result)
list_length_6 = ListLength(List=merge_5)
plane_normal_8 = PlaneNormal(Origin=merge_5, ZAxis=evaluate_surface_7.Normal)
panel_29 = Panel(list_length_6)
align_planes_4 = AlignPlanes(Planes=plane_normal_8)
list_length_7 = ListLength(List=align_planes_4)
series_4 = Series(Start=1, Step=1, Count=list_length_7)
concatenate_4 = Concatenate(FragmentA="X-", FragmentB=series_4)
panel_30 = Panel(concatenate_4)
text_5 = Text(Location=align_planes_4, Text=concatenate_4, Size=font_size_3, Font=list_item_13)
unroll_polysurface_5 = UnrollPolysurface(Polysurface=graft(surface_4), Curves=text_5)  # -> flatten(Unrolled), UnrolledPoints, UnrolledCurves
geometry_4 = Geometry(unroll_polysurface_5.Unrolled)

panel_31 = Panel(unroll_polysurface_5.UnrolledCurves)
stack_trees = StackTrees(
    Data0=unroll_polysurface_5.UnrolledCurves,
    Data1=unroll_polysurface.UnrolledCurves,
    Data2=unroll_polysurface_4.UnrolledCurves,
    Reduce=True)
merge_6 = Merge(Data1=unroll_polysurface_5.Unrolled, Data2=unroll_polysurface.Unrolled, Data3=unroll_polysurface_3.Unrolled)
stack_trees_2 = StackTrees(Data0=text_5, Data1=text, Data2=text_3, Reduce=True)
nested_text_curve = Curve(stack_trees)
nested_surface = Surface(merge_6)
_3d_text_curve = Curve(stack_trees_2)
nested_surface_2 = ClusterOutput(nested_surface)
panel_32 = Panel(_3d_text_curve)
list_length_8 = ListLength(List=nested_text_curve)
_3d_text_curve_2 = ClusterOutput(_3d_text_curve)
panel_33 = Panel(nested_surface)
nested_text_curve_2 = ClusterOutput(nested_text_curve)
panel_34 = Panel(list_length_8)
